# Grasshopper definition 00-1_mesh modeler-extended.gh (Grasshopper 0.9.76)
# Copyright: Co-de-iT
# plug-ins: MeshEdit Components, Human, MeshMirrorCut, Weaverbird

# automatic reference
# pipeline automatically references geometries from Rhinoceros
# setup names (or sarch masks) for:
# 
# . layer name
# . object name
# 
# You can also filter by geometry type (NURBS, mesh, curve, etc.)
# 
# we are referencing any mesh type object on the "work mesh" layer. Any added mesh on that layer will be automatically referenced in GH
pipeline = GeometryPipeline(
    GroupByLayer=False,
    GroupByType=False,
    IncludeHidden=True,
    IncludeLocked=True,
    LayerFilter="work mesh",
    NameFilter="*",
    TypeFilter=32)
mesh = Mesh(pipeline)
# subdivision style
subd = ValueList({"none": 0, "Catmull Clark": 1, "Loop": 2, "Combined 1": 3, "Combined 2": 4, "Combined 3": 5}, selected="Catmull Clark")
flip_normals = BooleanToggle(False)
mirror = BooleanToggle(False)

# ----
# Join, Weld e Unify Normals
wbjoin = WeaverbirdsJoinMeshesAndWeld(Mesh=mesh, Weld=True)
weldvertices = MeshWeldVertices(Mesh=wbjoin, Tolerance=Slider(0.01, range=0.01..10))  # -> RuntimeMessage, Mesh
unifynormals = MeshUnifyNormals(Mesh=weldvertices.Mesh)

# ----
# <title>
# 
# <description>
# 
# code by <author>
# 
# v <version>
# 
# © Co-de-iT 2018 _ Creative Commons Attribution-NonCommercial-ShareAlike 4.0 International License
panel = Panel("Flip (optional)")

gate = StreamGate(Stream=unifynormals, Gate=flip_normals)  # -> Target0, Target1
flip = MeshFlip(Mesh=gate.Target1)
filter = StreamFilter(Gate=flip_normals, Stream0=gate.Target0, Stream1=flip)

yz = YZPlane(Origin=Point(0, 0, 0))
# Mirror requires closed meshes
mmcut = MeshMirrorCut(Mesh=filter, Plane=yz, Threshold=Slider(0.001, range=0..1), Shrink=Toggle(True))
filter_2 = StreamFilter(Gate=mirror, Stream0=filter, Stream1=mmcut)
# Stream Gate passes data to the chosen channel.....
gate_2 = StreamGate(Stream=filter_2, Gate=subd)  # -> Target0, Target1, Target2, Target3, Target4, Target5
wbsplitquads = WeaverbirdsConstantQuadsSplitSubdivision(MeshCurves=gate_2.Target5, Level=Slider(1, range=1..3), SmoothNakedEdges=Slider(0, range=0..2))
wbsplitquads_2 = WeaverbirdsConstantQuadsSplitSubdivision(MeshCurves=gate_2.Target3, Level=Slider(1, range=1..3), SmoothNakedEdges=Slider(0, range=0..2))
wbsplitquads_3 = WeaverbirdsConstantQuadsSplitSubdivision(MeshCurves=gate_2.Target4, Level=Slider(1, range=1..3), SmoothNakedEdges=Slider(0, range=0..2))
wbloop = WeaverbirdsLoopSubdivision(MeshCurves=wbsplitquads, Level=Slider(1, range=1..3), SmoothNakedEdges=Slider(2, range=0..2))
wbcatmullclark = WeaverbirdsCatmullClarkSubdivision(MeshCurves=gate_2.Target1, Level=Slider(3, range=1..3), SmoothNakedEdges=Slider(2, range=0..2))
wbloop_2 = WeaverbirdsLoopSubdivision(MeshCurves=gate_2.Target2, Level=Slider(3, range=1..3), SmoothNakedEdges=Slider(2, range=0..2))
wbcatmullclark_2 = WeaverbirdsCatmullClarkSubdivision(MeshCurves=wbsplitquads_2, Level=Slider(2, range=1..3), SmoothNakedEdges=Slider(2, range=0..2))
wbloop_3 = WeaverbirdsLoopSubdivision(MeshCurves=wbsplitquads_3, Level=Slider(2, range=1..3), SmoothNakedEdges=Slider(2, range=0..2))
wbcatmullclark_3 = WeaverbirdsCatmullClarkSubdivision(MeshCurves=wbloop, Level=Slider(1, range=1..3), SmoothNakedEdges=Slider(2, range=0..2))
# ... and Stream Filter lets through the chosen channel only
filter_3 = StreamFilter(
    Gate=subd,
    Stream0=gate_2.Target0,
    Stream1=wbcatmullclark,
    Stream2=wbloop_2,
    Stream3=wbcatmullclark_2,
    Stream4=wbloop_3,
    Stream5=wbcatmullclark_3)

# ----
# bake this
mesh_2 = Mesh(filter_3)

# ----
# display only
# mesh
# naked edges
# clothed edges
# non-manifold edges
medges = MeshEdges(Mesh=mesh_2)  # -> NakedEdges, InteriorEdges, NonManifoldEdges
previewmat = CustomPreviewMaterials(Geometry=mesh_2, DiffuseColor=RGB(255, 255, 255), Transparency=Slider(0, range=0..1))
previewlw = CustomPreviewLineweights(
    Geometry=medges.NakedEdges,
    Shader=ColourSwatch(SwatchColor=RGB(204, 0, 255)),
    Thickness=Slider(3, range=0..10),
    Absolute=False)
previewlw_2 = CustomPreviewLineweights(Geometry=medges.InteriorEdges, Shader=ColourSwatch(SwatchColor=RGB(0, 0, 0)), Absolute=False)
previewlw_3 = CustomPreviewLineweights(Geometry=medges.NonManifoldEdges, Shader=ColourSwatch(SwatchColor=RGB(0, 0, 0)), Absolute=False)
