# Grasshopper definition 01-02_body generation-export.gh (Grasshopper 0.9.76)
# Copyright: Co-de-iT
# plug-ins: Human

# read an existing body file
# (just in case you don't remember how it looked like)
# read body.txt file
# import body.txt file
file = ReadFile(File="C:\Users\Alessio\Documents\GitHub\DBD_2018\workflow\P5_2_GH\body.txt", PerLineParse=True)
# body modeling
# Forward vector: . put forward vector here
# . forward vector is the vector that aligns with the field direction
Z = UnitZ(Factor=1)
# Body modeling: . keep body center in {0,0,0}
# . model each "limb" as a line starting from 0 and ending on the tip point
# . collect the lines in the component above
crv = Curve([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])
pt = Point(file)
split = SplitList(List=pt, Index="1")  # -> ListA, ListB
pt_2 = Point(Point(0, 0, 0))
amp = Amplitude(Vector=split.ListA, Amplitude=Slider(7.55, range=0..10))
len = Length(Curve=crv)
ln = Line(StartPoint=pt_2, EndPoint=split.ListB)
limb_size = Panel(len)
end = EndPoints(Curve=crv)  # -> Start, End
# forward vector
vdisex = VectorDisplayEx(Point=pt_2, Vector=amp, Colour=RGB(0, 0, 0), Width=2)
# limbs
previewlw = CustomPreviewLineweights(Geometry=ln, Shader=ColourSwatch(SwatchColor=RGB(255, 255, 255)), Thickness=Slider(3, range=1..5), Absolute=False)
merge = Merge(Data1=Z, Data2=end.End)

custom_subdir = Panel("GH_2_P5\data")
# 01-02_body generation-export
# 
# Model and export bodies for agent-basd simulation
# 
# code by Alessio Erioli
# 
# v 0.1
# 
# © Co-de-iT 2018 _ Creative Commons Attribution-NonCommercial-ShareAlike 4.0 International License
dir_type = ValueList({"desktop": 0, "documents": 1, "GH file path": 2, "C:": 3}, selected="GH file path")
f_pathg = PathGenerator(type=dir_type, subDir=custom_subdir)  # -> dir; inputs type: Int32, subDir: String
# ---------- f_pathg: C# ----------
                           /*
    froGH - a sparse collection of (in)utilities for Grasshopper

    Path Generator
    code by Alessio Erioli - value list generation based on code by James Ramsden

    froGH by Co-de-iT is licensed under a Creative Commons Attribution 4.0 International License.
    http://creativecommons.org/licenses/by/4.0/

    */
    initComp();


    String S = "";
    String root = "";
    String end = "\\";
    String eol = Environment.NewLine;

    // __________________ autoList part __________________

    // variable for the list
    Grasshopper.Kernel.Special.GH_ValueList vList;
    // tries to cast input as list
    try{

      // if the list is not the first parameter then change Input[0] to the corresponding value
      vList = (Grasshopper.Kernel.Special.GH_ValueList) Component.Params.Input[0].Sources[0];
      // Print("value list connected");
      // check if the list must be created
      //if (vList.NickName != "dir type"){
      if (!vList.NickName.Equals("dir type")){
        vList.ClearData();
        vList.ListItems.Clear();
        vList.NickName = "dir type";
        var item1 = new Grasshopper.Kernel.Special.GH_ValueListItem("desktop", "0");
        var item2 = new Grasshopper.Kernel.Special.GH_ValueListItem("documents", "1");
        var item3 = new Grasshopper.Kernel.Special.GH_ValueListItem("GH file path", "2");
        var item4 = new Grasshopper.Kernel.Special.GH_ValueListItem("C:", "3");
        vList.ListItems.Add(item1);
        vList.ListItems.Add(item2);
        vList.ListItems.Add(item3);
        vList.ListItems.Add(item4);

        vList.ListItems[0].Value.CastTo(out type);
      }
    }
    catch{
      // handles anything that is not a value list
    }


    switch(type){
      case 0:
        root = Environment.GetFolderPath(Environment.SpecialFolder.Desktop) + end;
        S = "Desktop";
        break;
      case 1:
        root = Environment.GetFolderPath(Environment.SpecialFolder.MyDocuments) + end;
        S = "Documents";
        break;
      case 2:
        GH_Document ghDoc = owner.OnPingDocument();

        if (ghDoc.IsFilePathDefined)
        {
          int nameLen = ghDoc.DisplayName.TrimEnd('*').Length + 3; // +3 accounts for the '.gh' extension
          int fileLen = ghDoc.FilePath.TrimEnd('*').Length;

          //F = ghDoc.DisplayName.TrimEnd('*');
          root = ghDoc.FilePath.Substring(0, fileLen - nameLen);
          //root = gh_d.FilePath;
          S = "GH File path";
        }
        else
        {
          Print("No path defined. Saving to Desktop until then");
          root = Environment.GetFolderPath(Environment.SpecialFolder.Desktop);
          S = "Desktop";
        }
        break;
      case 3:
        root = "C:" + end;
        S = root + end;
        break;
    }
    dir = root + (subDir != null ? (subDir + end) : "");
    Component.Message = S;
# ---------- f_pathg: C# additional code ----------
  void initComp(){
    Component.Name = "Path Generator";
    Component.NickName = "f_PathG";
    Component.Description = "generates a path based on local direcories such as Desktop, Documents, GH file path";
    Component.Params.Input[0].Name = "dir type";
    Component.Params.Input[0].Description = "directory type: 0 desktop, 1 documents, 2 GH file path, 3 C:\nconnect a value list for automatic list generation";
    Component.Params.Input[1].Name = "custom subdir";
    Component.Params.Input[1].Description = "(optional) custom subdirectory";
  }
# ---------- end f_pathg ----------
destination_directory = Panel(f_pathg)

expression = Expression(P=merge, Expression="Format(\"{0},{1},{2}\",P.x,P.y,P.z)")
file_name_extension = Panel("body.txt")
txt = Text(flatten(expression))
save = Button()
f_str2file = SaveStringToFile(S=txt, dir=f_pathg, file=file_name_extension, save=save)  # -> info; inputs S: list of String, dir: String, file: String, save: Boolean
# ---------- f_str2file: C# ----------
                           /*
    froGH - a sparse collection of (in)utilities for Grasshopper

    Save string to file

    code by Alessio Erioli

    froGH by Co-de-iT is licensed under a Creative Commons Attribution 4.0 International License.
    http://creativecommons.org/licenses/by/4.0/

    */

    initComp();



    if (save){
      if (!Directory.Exists(dir)) Directory.CreateDirectory(dir);

      String target = dir + file;

      System.IO.File.WriteAllLines(target, S.ToArray());
      info = "file saved as: " + target;
    } else {
      info = "press save button to save file";
    }
# ---------- f_str2file: C# additional code ----------
  void initComp(){
    Component.Name = "Save String to File";
    Component.NickName = "f_Str2File";
    Component.Description = "Saves a text sequence to a file";

    Component.Params.Input[0].Name = "String";
    Component.Params.Input[0].Description = "string to save (as List)";
    Component.Params.Input[1].Name = "directory";
    Component.Params.Input[1].Description = "directory where the string file is saved";
    Component.Params.Input[2].Name = "fileName";
    Component.Params.Input[2].Description = "file name and extension (ex: myText.txt)";
    Component.Params.Input[3].Name = "save";
    Component.Params.Input[3].Description = "activate saving - attach a button and click to save";
    Component.Params.Output[0].Name = "info";
    Component.Params.Output[0].Description = "information on the saving process";
  }
# ---------- end f_str2file ----------
