# Grasshopper definition 01_1_M00_Millipede topo 3D basic.gh (Grasshopper 0.9.76)
# Copyright: Co-de-iT
# plug-ins: Human, Millipede

angle = Slider(20, range=0..100)
# Millipede works in METERS (set Rhino units to meters before using Millipede)
# load
brep = Brep(<brep referenced from the Rhino model>)
neg = Negative(Value=Slider(161499.9, range=0..500000))
Z = UnitZ(Factor=neg)
X = UnitX(Factor=1)
rad = Radians(Degrees=angle)
vrot = Rotate(Vector=Z, Axis=X, Angle=rad)
# 01_1_M00_Millipede topo 3D basic
# 
# basic use of Millipede Topological Optimization 3D
# 
# code by Alessio Erioli
# 
# v 0.1
# 
# © Co-de-iT 2018 _ Creative Commons Attribution-NonCommercial-ShareAlike 4.0 International License
load = _3DLoadRegion(Boundary=brep, Load=vrot)

toggle = BooleanToggle(True)
# void(optional)
brep_2 = Brep([<brep referenced from the Rhino model> x2])
boundary = _3DBoundaryRegion(Boundary=brep_2, IsVoid=brep)

# ----
# volume
brep_3 = Brep(<brep referenced from the Rhino model>)
boundary_2 = _3DBoundaryRegion(Boundary=brep_3, IsVoid=Toggle(False))

# ----
# support
brep_4 = Brep(<brep referenced from the Rhino model>)
mat = MillC_StockSupportType(X=True, Y=True, Z=True, RX=True, RY=True, RZ=True)
support = _3DSupportRegion(Boundary=brep_4, SupportType=mat, AmendExistingSupports=True)

bbox = BoundingBox(Content=brep_3, Plane=PlaneXY(0, 0, 0), UnionBox=True)  # -> Box, Box_2
boxprop = BoxProperties(Box=bbox.Box)  # -> Center, Diagonal, Area, Volume, Degeneracy
n_cells_along_x = Slider(25, range=2..29)

# ----
# the higher the cells count, the slower the calculation
# estimated Y & Z cells number, proportional to the number of cells in X
bbox_2 = BoundingBox(Content=brep_3, Plane=PlaneXY(0, 0, 0), UnionBox=True)  # -> Box, Box_2
boxprop_2 = BoxProperties(Box=bbox_2.Box)  # -> Center, Diagonal, Area, Volume, Degeneracy
devec = DeconstructVector(Vector=boxprop_2.Diagonal)  # -> XComponent, YComponent, ZComponent
division = Division(A=devec.XComponent, B=n_cells_along_x)
integer_division = IntegerDivision(A=devec.YComponent, B=division)
integer_division_2 = IntegerDivision(A=devec.ZComponent, B=division)
cells_along_y_and_z = Panel([integer_division, integer_division_2])

opt_iterations = Slider(4, range=0..4)
smoothing = Slider(0.13, range=0..1)
target_density = Slider(0.2, range=0..1)

# ----
# TopoStruct 3D Model: deactivete-reactivate this to change model
topostruct_3d = Topostruct3DModel(ModelComponents=[boundary_2, support, load, boundary], XResolution=n_cells_along_x)  # -> FEModel, CellCentres, CellSize; disabled

cell_size = Panel(topostruct_3d.CellSize)
# cell center points
pt = Point(topostruct_3d.CellCentres)

# ----
# TopoStruct 3D Solver: do NOT deactivate-reactivate this component
topostruct_3d_solver = Topostruct3DSolver(
    FEModel=topostruct_3d.FEModel,
    SelfWeightCoefficient=0,
    OptimisationIterations=opt_iterations,
    Smoothing=smoothing,
    Penalization=3,
    TargetDensity=target_density,
    MinimumDensity=0.001,
    DeleteThreshold=0.5,
    PeriodicX=False,
    PeriodicY=False,
    PeriodicZ=False,
    LoadCase=0,
    AllCases=True)  # -> FEModel, MaxDeflection

# ----
# 3D cell results: Principal Stress Planes
# Principal Stress Values (Vector)
# Von Mises Stress
# Density
_3d_cell_results = _3DCellResults(FEModel=topostruct_3d_solver.FEModel)  # -> PrincipalStressPlanes, PrincipalStresses, VonMisesStress, Density

# ----
# vectorfield
pln = Plane(_3d_cell_results.PrincipalStressPlanes)
deplane = DeconstructPlane(Plane=pln)  # -> Origin, XAxis, YAxis, ZAxis
number_slider = Slider(20, range=0..30)
line = LineSDL(Start=deplane.Origin, Direction=deplane.XAxis, Length=number_slider)
line_2 = LineSDL(Start=deplane.Origin, Direction=deplane.YAxis, Length=number_slider)
line_3 = LineSDL(Start=deplane.Origin, Direction=deplane.ZAxis, Length=number_slider)
panel = Panel("Pstress 1 - (usually) compression")
panel_2 = Panel("Pstress 2 - (usually) tension")
panel_3 = Panel("Pstress 3 - (usually) tension")

# ----
# stresslines
stress_lines = StressLines(FEModel=topostruct_3d_solver.FEModel, Seeds=pt)  # -> Curves1, Curves2, Curves3
crv = Curve(stress_lines.Curves1)
crv_2 = Curve(stress_lines.Curves2)
crv_3 = Curve(stress_lines.Curves3)

# ---- group: for display only
panel_4 = Panel("""0
0
0
1""")
cull = CullPattern(List=crv, CullPattern="1")
len = Length(Curve=cull)
bnd = Bounds(Numbers=len)
remap = RemapNumbers(Value=len, Source=bnd, Target=Domain(0, 1))  # -> Mapped, Clipped
gradient = Gradient(LowerLimit=0, UpperLimit=1, Parameter=remap.Mapped, stops=[0: RGB(0, 0, 0), 1: RGB(237, 237, 237)])
previewlw = CustomPreviewLineweights(Geometry=cull, Shader=gradient, Absolute=False)
