# Grasshopper definition 01_1_M01_Millipede topo 3D field generation.gh (Grasshopper 0.9.76)
# Copyright: Co-de-iT
# plug-ins: Human, Millipede

angle = Slider(20, range=0..100)
# load
brep = Brep(<brep referenced from the Rhino model>)
neg = Negative(Value=Slider(161499.9, range=0..500000))
Z = UnitZ(Factor=neg)
X = UnitX(Factor=1)
rad = Radians(Degrees=angle)
vrot = Rotate(Vector=Z, Axis=X, Angle=rad)
# 01_1_M01_Millipede topo 3D field generation
# 
# Millipede Topology Optimization 3D and field export
# 
# code by Alessio Erioli
# 
# v 0.1
# 
# © Co-de-iT 2018 _ Creative Commons Attribution-NonCommercial-ShareAlike 4.0 International License
load = _3DLoadRegion(Boundary=brep, Load=vrot)

# ----
# void(optional)
brep_2 = Brep([<brep referenced from the Rhino model> x2])
boundary = _3DBoundaryRegion(Boundary=brep_2, IsVoid=Toggle(True))

# ----
# volume
brep_3 = Brep(<brep referenced from the Rhino model>)
boundary_2 = _3DBoundaryRegion(Boundary=brep_3, IsVoid=Toggle(False))

# ----
# support
brep_4 = Brep(<brep referenced from the Rhino model>)
mat = MillC_StockSupportType(X=True, Y=True, Z=True, RX=True, RY=True, RZ=True)
support = _3DSupportRegion(Boundary=brep_4, SupportType=mat, AmendExistingSupports=True)

n_cells_along_x = Slider(25, range=2..29)

# ----
# estimated Y & Z cells number, proportional to the number of cells in X
bbox = BoundingBox(Content=brep_3, Plane=PlaneXY(0, 0, 0), UnionBox=True)  # -> Box, Box_2
boxprop = BoxProperties(Box=bbox.Box)  # -> Center, Diagonal, Area, Volume, Degeneracy
devec = DeconstructVector(Vector=boxprop.Diagonal)  # -> XComponent, YComponent, ZComponent
division = Division(A=devec.XComponent, B=n_cells_along_x)
integer_division = IntegerDivision(A=devec.YComponent, B=division)
integer_division_2 = IntegerDivision(A=devec.ZComponent, B=division)
cells_along_y_and_z = Panel([integer_division, integer_division_2])

opt_iterations = Slider(4, range=0..4)
smoothing = Slider(0.13, range=0..1)
target_density = Slider(0.2, range=0..1)

# ----
# deactivete-reactivate this to change model
topostruct_3d = Topostruct3DModel(ModelComponents=[boundary_2, support, load, boundary], XResolution=n_cells_along_x)  # -> FEModel, CellCentres, CellSize; disabled

cell_size = Panel(topostruct_3d.CellSize)

# ----
# do NOT deactivate-reactivate this component
topostruct_3d_solver = Topostruct3DSolver(
    FEModel=topostruct_3d.FEModel,
    SelfWeightCoefficient=0,
    OptimisationIterations=opt_iterations,
    Smoothing=smoothing,
    Penalization=3,
    TargetDensity=target_density,
    MinimumDensity=0.001,
    DeleteThreshold=0.5,
    PeriodicX=False,
    PeriodicY=False,
    PeriodicZ=False,
    LoadCase=0,
    AllCases=True)  # -> FEModel, MaxDeflection

# ----
# cell center points
pt = Point(topostruct_3d.CellCentres)
# insert values to discretize here
_3d_cell_results = _3DCellResults(FEModel=topostruct_3d_solver.FEModel)  # -> PrincipalStressPlanes, PrincipalStresses, VonMisesStress, Density

# ----
# vectorfield
pln = Plane(_3d_cell_results.PrincipalStressPlanes)
deplane = DeconstructPlane(Plane=pln)  # -> Origin, XAxis, YAxis, ZAxis
number_slider = Slider(20, range=0..30)
line = LineSDL(Start=deplane.Origin, Direction=deplane.XAxis, Length=number_slider)
line_2 = LineSDL(Start=deplane.Origin, Direction=deplane.YAxis, Length=number_slider)
line_3 = LineSDL(Start=deplane.Origin, Direction=deplane.ZAxis, Length=number_slider)
panel = Panel("Pstress 1 - compression")
panel_2 = Panel("Pstress 2 - tension")
panel_3 = Panel("Pstress 3 - tension")

# ----
# converts a continuous value range in discrete integer steps (useful for body type assignemnt)
n_of_components = Slider(4, range=1..6)
# scalar field to discrete values
num = Number(_3d_cell_results.VonMisesStress)
bnd = Bounds(Numbers=num)
remap = RemapNumbers(Value=num, Source=bnd, Target=Domain(0, 1))  # -> Mapped, Clipped
subtraction = Subtraction(A=n_of_components, B="1")
multiplication = Multiplication(A=remap.Mapped, B=subtraction)

# ----
# stresslines
stress_lines = StressLines(FEModel=topostruct_3d_solver.FEModel, Seeds=pt)  # -> Curves1, Curves2, Curves3
crv = Curve(stress_lines.Curves1)
crv_2 = Curve(stress_lines.Curves2)
crv_3 = Curve(stress_lines.Curves3)

# ----
# maxStress values (Von Mises Stress)
number_slider_2 = Slider(3.328, range=0..10)
# density values
num_2 = Number(_3d_cell_results.Density)
bnd_2 = Bounds(Numbers=num_2)
dom = Domain(DomainStart=Slider(0.1, range=0..5), DomainEnd=number_slider_2)
remap_2 = RemapNumbers(Value=num_2, Source=bnd_2, Target=dom)  # -> Mapped, Clipped
resolution = ValueList({"coarse": 0, "fine": 1, "extra fine": 2}, selected="fine")
fastdotdis = DotDisplayFast(point=pt, radius=remap_2.Mapped, resolution=resolution)

# ---- group: for display only
panel_4 = Panel("""0
0
0
1""")
cull = CullPattern(List=crv_3, CullPattern="1")
len = Length(Curve=cull)
bnd_3 = Bounds(Numbers=len)
remap_3 = RemapNumbers(Value=len, Source=bnd_3, Target=Domain(0, 1))  # -> Mapped, Clipped
gradient = Gradient(LowerLimit=0, UpperLimit=1, Parameter=remap_3.Mapped, stops=[0: RGB(0, 0, 0), 1: RGB(237, 237, 237)])
previewlw = CustomPreviewLineweights(Geometry=cull, Shader=gradient, Absolute=False)

# ----
num_3 = Number(_3d_cell_results.VonMisesStress)
bnd_4 = Bounds(Numbers=num_3)
dom_2 = Domain(DomainStart=Slider(1.04, range=0..5), DomainEnd=Slider(10, range=0..20))
remap_4 = RemapNumbers(Value=num_3, Source=bnd_4, Target=dom_2)  # -> Mapped, Clipped
resolution_2 = ValueList({"coarse": 0, "fine": 1, "extra fine": 2}, selected="fine")
fastdotdis_2 = DotDisplayFast(point=pt, radius=remap_4.Mapped, resolution=resolution_2)

# ----
# copy/paste (or bake to Rhino):
# vector field directions
crv_4 = Curve(line)
# vector field base points
pt_2 = Point(pt)
# for agent body type (if more than one)
int = Integer(multiplication)

# ==== cluster DotDisplayFast: like Dot Display, but faster (black dots only)
radius = ClusterInput()
point = ClusterInput()
resolution = ClusterInput()  # 0 = coarse, 1 = fine, 2 = extra-fine
filter = StreamFilter(Gate=resolution, Stream0="5", Stream1="10", Stream2="20")
material = CreateMaterial(Diffuse="black", Specular="black", Emission="black", Transparency=0, Shine=0)
msphere = MeshSphere(Base=point, Radius=radius, UCount=filter, VCount=filter)
mjoin = MeshJoin(Meshes=msphere)
preview = CustomPreview(Geometry=mjoin, Shader=material)
