# Grasshopper definition 01_field generation.gh (Grasshopper 0.9.76)
# Copyright: Co-de-iT
# plug-ins: Human

field_curves = ValueList({"random lines": 0, "predefined-single": 1, "predefined-lines": 2}, selected="predefined-lines")
field_points = ValueList({"random": 0, "grid": 1}, selected="random")
random_lines = Slider(20, range=20..1000)
field_random_points = Slider(3000, range=20..5000)
power = Slider(5, range=0..5)
n_cells = Slider(15, range=10..50)

# ---- group: initial box volume
brep = Brep(<brep referenced from the Rhino model>)

# ----
mbox = MeshBox(Base=brep, XCount="1", YCount="1", ZCount="1")

# ---- group: point grid generation
boxprop = BoxProperties(Box=brep)  # -> Center, Diagonal, Area, Volume, Degeneracy
devec = DeconstructVector(Vector=boxprop.Diagonal)  # -> XComponent, YComponent, ZComponent
expression = Expression(C=boxprop.Center, D=boxprop.Diagonal, Expression="C-(D*0.5)")
max = Maximum(A=devec.XComponent, B=devec.YComponent)
max_2 = Maximum(A=max, B=devec.ZComponent)
division = Division(A=max_2, B=n_cells)
division_2 = Division(A=devec.XComponent, B=division)
division_3 = Division(A=devec.YComponent, B=division)
division_4 = Division(A=devec.ZComponent, B=division)
series = Series(Start=0, Step=division, Count=division_4)
sqgrid = Square(Plane=expression, Size=division, ExtentX=division_2, ExtentY=division_3)  # -> Cells, Points
Z = UnitZ(Factor=series)
move = Move(Geometry=graft(sqgrid.Points), Motion=Z)  # -> graft(Geometry), Transform
lng = ListLength(List=flatten(move.Geometry))

# ----
n_of_field_grid_points = Panel(lng)
# 01_field generation
# 
# generate field for agent-based design
# 
# code by Alessio Erioli
# 
# v 0.1
# 
# © Co-de-iT 2018 _ Creative Commons Attribution-NonCommercial-ShareAlike 4.0 International License
random_populate_mesh = CSharpScript(M=mbox, n=random_lines, s="1")  # -> Pts; inputs M: Mesh, V: Mesh, n: Int32, s: Int32
# ---------- random_populate_mesh: C# ----------
    Random r = new Random(s);
    BoundingBox b = new BoundingBox(M.Vertices.ToPoint3dArray());
    Point3d max = b.Max;
    Point3d min = b.Min;
    double x,y,z;
    int count = 0, i = 0;
    List<Point3d> pts = new List<Point3d>();
    List<Point3d> ptsOut = new List<Point3d>();

    while (count < n){

      x = b.Min.X + r.NextDouble() * (b.Max.X - b.Min.X);
      y = b.Min.Y + r.NextDouble() * (b.Max.Y - b.Min.Y);
      z = b.Min.Z + r.NextDouble() * (b.Max.Z - b.Min.Z);
      Point3d p = new Point3d(x, y, z);

      if (M.IsPointInside(p, 0.1, false) && (V == null ? true : !V.IsPointInside(p, 0.1, false))){
        pts.Add(p);
        count++;
      } else{
        ptsOut.Add(p);
      }

      i++;
    }

    Pts = pts;
    //PtsO = ptsOut;
# ---------- end random_populate_mesh ----------
jitter = Jitter(List=random_populate_mesh, Jitter=1, Seed=2)  # -> Values, Indices
ln = Line(StartPoint=graft(random_populate_mesh), EndPoint=graft(jitter.Values))  # -> flatten(Line)

# ---- group: avoid zero-length
len = Length(Curve=ln)
equals = Equality(FirstNumber=len, SecondNumber="0")  # -> Equality, Inequality

# ----
crv = Curve(reparameterize([<curve referenced from the Rhino model> x2]))
crv_2 = Curve(reparameterize(<curve referenced from the Rhino model>))

# ---- group: random field curves
dispatch = Dispatch(List=ln, DispatchPattern=equals.Inequality)  # -> ListA, ListB

# ---- group: random field points
pop3d = Populate3D(Region=brep, Count=field_random_points, Seed=1)  # -> graft(Population)

# ---- group: points
filter = StreamFilter(Gate=field_points, Stream0=pop3d, Stream1=move.Geometry)  # -> simplify(Stream)

# ---- group: Void
mesh = Mesh([<mesh referenced from the Rhino model> x2])

# ---- group: Solid
mesh_2 = Mesh(<mesh referenced from the Rhino model>)

# ----
n_of_agents = Slider(800, range=20..5000)
seed = Slider(32, range=1..100)

# ---- group: Filtered points
cluster = Cluster(points=filter, solid_volume=mesh_2, void=mesh)

# ----
mjoin = MeshJoin(Meshes=mesh)
mjoin_2 = MeshJoin(Meshes=mesh_2)
field_volume_filtering = BooleanToggle(False)
random_populate_mesh_2 = CSharpScript(M=mjoin_2, V=mjoin, n=n_of_agents, s=seed)  # -> graft(Pts); inputs M: Mesh, V: Mesh, n: Int32, s: Int32; same code as random_populate_mesh
filter_2 = StreamFilter(Gate=field_volume_filtering, Stream0=filter, Stream1=cluster)  # -> simplify(Stream)

# ---- group: curves (lines)
filter_3 = StreamFilter(Gate=field_curves, Stream0=dispatch.ListA, Stream1=crv_2, Stream2=crv)

# ----
# field lines display
swatch = ColourSwatch(SwatchColor=RGB(255, 255, 255))
previewlw = CustomPreviewLineweights(Geometry=filter_3, Shader=swatch, Thickness="3", Absolute=False)

# ----
# random vectors
number_slider = Slider(1, range=0..100)
lng_2 = ListLength(List=flatten(random_populate_mesh_2))
random = Random(Range="0 to 1000", Number="3", Seed=number_slider, Integers=True)
item = ListItem(List=random, Index=0, Wrap=True)  # -> Item, Item1, Item2
random_2 = Random(Range="-1 to 1", Number=lng_2, Seed=item.Item2)
random_3 = Random(Range="-1 to 1", Number=lng_2, Seed=item.Item1)
random_4 = Random(Range="-1 to 1", Number=lng_2, Seed=item.Item)
vec = VectorXYZ(XComponent=random_4, YComponent=random_3, ZComponent=random_2)  # -> Vector, Length

# ---- group: points
pt = Point(flatten(filter_2))

# ---- group: agents positions
pt_2 = Point(flatten(random_populate_mesh_2))

# ---- group: agents directions
vec_2 = Vector(flatten(vec.Vector))

# ----
# agents direction display
unit = UnitVector(Vector=vec_2)
color = ValueList({"mono": 0, "by N dir": 1}, selected="mono")
filter_4 = StreamFilter(Gate=color, Stream0=ColourSwatch(SwatchColor=RGB(0, 0, 0)), Stream1=unit)
amp = Amplitude(Vector=unit, Amplitude=Slider(25, range=0..100))
vdisex = VectorDisplayEx(Point=pt_2, Vector=amp, Colour=filter_4, Width=2)

custom_subdir = Panel("GH_2_P5\data")
dir_type = ValueList({"desktop": 0, "documents": 1, "GH file path": 2, "C:": 3}, selected="GH file path")
f_pathg = PathGenerator(type=dir_type, subDir=custom_subdir)  # -> dir; inputs type: Int32, subDir: String
# ---------- f_pathg: C# ----------
                           /*
    froGH - a sparse collection of (in)utilities for Grasshopper

    Path Generator
    code by Alessio Erioli - value list generation based on code by James Ramsden

    froGH by Co-de-iT is licensed under a Creative Commons Attribution 4.0 International License.
    http://creativecommons.org/licenses/by/4.0/

    */
    initComp();


    String S = "";
    String root = "";
    String end = "\\";
    String eol = Environment.NewLine;

    // __________________ autoList part __________________

    // variable for the list
    Grasshopper.Kernel.Special.GH_ValueList vList;
    // tries to cast input as list
    try{

      // if the list is not the first parameter then change Input[0] to the corresponding value
      vList = (Grasshopper.Kernel.Special.GH_ValueList) Component.Params.Input[0].Sources[0];
      // Print("value list connected");
      // check if the list must be created
      //if (vList.NickName != "dir type"){
      if (!vList.NickName.Equals("dir type")){
        vList.ClearData();
        vList.ListItems.Clear();
        vList.NickName = "dir type";
        var item1 = new Grasshopper.Kernel.Special.GH_ValueListItem("desktop", "0");
        var item2 = new Grasshopper.Kernel.Special.GH_ValueListItem("documents", "1");
        var item3 = new Grasshopper.Kernel.Special.GH_ValueListItem("GH file path", "2");
        var item4 = new Grasshopper.Kernel.Special.GH_ValueListItem("C:", "3");
        vList.ListItems.Add(item1);
        vList.ListItems.Add(item2);
        vList.ListItems.Add(item3);
        vList.ListItems.Add(item4);

        vList.ListItems[0].Value.CastTo(out type);
      }
    }
    catch{
      // handles anything that is not a value list
    }


    switch(type){
      case 0:
        root = Environment.GetFolderPath(Environment.SpecialFolder.Desktop) + end;
        S = "Desktop";
        break;
      case 1:
        root = Environment.GetFolderPath(Environment.SpecialFolder.MyDocuments) + end;
        S = "Documents";
        break;
      case 2:
        GH_Document ghDoc = owner.OnPingDocument();

        if (ghDoc.IsFilePathDefined)
        {
          int nameLen = ghDoc.DisplayName.TrimEnd('*').Length + 3; // +3 accounts for the '.gh' extension
          int fileLen = ghDoc.FilePath.TrimEnd('*').Length;

          //F = ghDoc.DisplayName.TrimEnd('*');
          root = ghDoc.FilePath.Substring(0, fileLen - nameLen);
          //root = gh_d.FilePath;
          S = "GH File path";
        }
        else
        {
          Print("No path defined. Saving to Desktop until then");
          root = Environment.GetFolderPath(Environment.SpecialFolder.Desktop);
          S = "Desktop";
        }
        break;
      case 3:
        root = "C:" + end;
        S = root + end;
        break;
    }
    dir = root + (subDir != null ? (subDir + end) : "");
    Component.Message = S;
# ---------- f_pathg: C# additional code ----------
  void initComp(){
    Component.Name = "Path Generator";
    Component.NickName = "f_PathG";
    Component.Description = "generates a path based on local direcories such as Desktop, Documents, GH file path";
    Component.Params.Input[0].Name = "dir type";
    Component.Params.Input[0].Description = "directory type: 0 desktop, 1 documents, 2 GH file path, 3 C:\nconnect a value list for automatic list generation";
    Component.Params.Input[1].Name = "custom subdir";
    Component.Params.Input[1].Description = "(optional) custom subdirectory";
  }
# ---------- end f_pathg ----------
# export field
destination_directory = Panel(f_pathg)

custom_subdir_2 = Panel("GH_2_P5\data")
dir_type_2 = ValueList({"desktop": 0, "documents": 1, "GH file path": 2, "C:": 3}, selected="GH file path")
f_pathg_2 = PathGenerator(type=dir_type_2, subDir=custom_subdir_2)  # -> dir; inputs type: Int32, subDir: String; same code as f_pathg
# export agents
destination_directory_2 = Panel(f_pathg_2)

expression_2 = Expression(P=pt_2, Expression="Format(\"{0},{1},{2}\",P.x,P.y,P.z)")
expression_3 = Expression(P=vec_2, Expression="Format(\"{0},{1},{2}\",P.x,P.y,P.z)")
body_type = Panel("0")
expression_4 = Expression(p=expression_2, v=expression_3, t=body_type, Expression="Format(\"{0} {1} {2}\", p, v,t)")
file_name_extension = Panel("agents.txt")
save = Button()
txt = Text(flatten(expression_4))
f_str2file = SaveStringToFile(S=txt, dir=f_pathg_2, file=file_name_extension, save=save)  # -> info; inputs S: list of String, dir: String, file: String, save: Boolean
# ---------- f_str2file: C# ----------
                           /*
    froGH - a sparse collection of (in)utilities for Grasshopper

    Save string to file

    code by Alessio Erioli

    froGH by Co-de-iT is licensed under a Creative Commons Attribution 4.0 International License.
    http://creativecommons.org/licenses/by/4.0/

    */

    initComp();



    if (save){
      if (!Directory.Exists(dir)) Directory.CreateDirectory(dir);

      String target = dir + file;

      System.IO.File.WriteAllLines(target, S.ToArray());
      info = "file saved as: " + target;
    } else {
      info = "press save button to save file";
    }
# ---------- f_str2file: C# additional code ----------
  void initComp(){
    Component.Name = "Save String to File";
    Component.NickName = "f_Str2File";
    Component.Description = "Saves a text sequence to a file";

    Component.Params.Input[0].Name = "String";
    Component.Params.Input[0].Description = "string to save (as List)";
    Component.Params.Input[1].Name = "directory";
    Component.Params.Input[1].Description = "directory where the string file is saved";
    Component.Params.Input[2].Name = "fileName";
    Component.Params.Input[2].Description = "file name and extension (ex: myText.txt)";
    Component.Params.Input[3].Name = "save";
    Component.Params.Input[3].Description = "activate saving - attach a button and click to save";
    Component.Params.Output[0].Name = "info";
    Component.Params.Output[0].Description = "information on the saving process";
  }
# ---------- end f_str2file ----------

# ----
# field calculation
crv_cp = CurveClosestPoint(Point=filter_2, Curve=filter_3)  # -> Point, Parameter, Distance
vec2pt = Vector2Pt(PointA=filter_2, PointB=crv_cp.Point, Unitize=True)  # -> Vector, Length
eval = EvaluateCurve(Curve=filter_3, Parameter=crv_cp.Parameter)  # -> Point, Tangent, Angle
xprod = CrossProduct(VectorA=vec2pt.Vector, VectorB=eval.Tangent, Unitize=False)  # -> Vector, Length

# ---- group: avoid division by 0
addition = Addition(A=crv_cp.Distance, B=Slider(0.01, range=0..1))

# ----
one_over_x = OneOverX(Value=addition)
pow = Power(A=one_over_x, B=power)
wav = WeightedAverage(Input=xprod.Vector, Weights=pow)

# ---- group: vectors
vec_3 = Vector(flatten(wav))

# ---- group: vectors from field
cp = ClosestPoint(Point=random_populate_mesh_2, Cloud=pt)  # -> ClosestPoint, CPIndex, Distance
item_2 = ListItem(List=vec_3, Index=cp.CPIndex, Wrap=True)

# ----
# field display
unit_2 = UnitVector(Vector=vec_3)
color_2 = ValueList({"mono": 0, "by N dir": 1}, selected="by N dir")
filter_5 = StreamFilter(Gate=color_2, Stream0=ColourSwatch(SwatchColor=RGB(0, 0, 0)), Stream1=unit_2)
amp_2 = Amplitude(Vector=unit_2, Amplitude=Slider(25, range=0..100))
vdisex_2 = VectorDisplayEx(Point=pt, Vector=amp_2, Colour=filter_5, Width=2)

expression_5 = Expression(P=pt, Expression="Format(\"{0},{1},{2}\",P.x,P.y,P.z)")
expression_6 = Expression(P=vec_3, Expression="Format(\"{0},{1},{2}\",P.x,P.y,P.z)")
type = Panel("0")
expression_7 = Expression(p=expression_5, v=expression_6, t=type, Expression="Format(\"{0} {1} {2}\", p, v,t)")
file_name_extension_2 = Panel("field.txt")
txt_2 = Text(flatten(expression_7))
save_2 = Button()
f_str2file_2 = SaveStringToFile(S=txt_2, dir=f_pathg, file=file_name_extension_2, save=save_2)  # -> info; inputs S: list of String, dir: String, file: String, save: Boolean; same code as f_str2file

# ==== cluster Cluster
points = ClusterInput()  # Points
solid_volume = ClusterInput()  # Solid Volume
void = ClusterInput()  # Void
mjoin = MeshJoin(Meshes=solid_volume)
mjoin_2 = MeshJoin(Meshes=void)
minc = MeshInclusion(Mesh=mjoin, Point=points, Strict=False)
minc_2 = MeshInclusion(Mesh=mjoin_2, Point=points, Strict=False)
not = GateNot(A=minc_2)
and = GateAnd(A=minc, B=not)
dispatch = Dispatch(List=points, DispatchPattern=and)  # -> ListA, ListB
clean = CleanTree(RemoveNulls=True, RemoveInvalid=True, RemoveEmpty=True, Tree=dispatch.ListA)  # -> flatten(Tree)
pt = Point(graft(clean))
filtered_points = ClusterOutput(pt)  # FIltered Points
