# Grasshopper definition 03_0_import bodies_types_extended.gh (Grasshopper 0.9.76)
# Copyright: Co-de-iT
# plug-ins: Human, Kangaroo2 Components, Mesh Pipe, IntraLattice

F = File("C:\Users\Alessio\Documents\GitHub\P5_DesignByData_EPC_2018\workflow\P5_2_GH\20180118-095350_struct_topoXt.txt")
panel = Panel(F)
# drag here the .txt file from
# 
# P5_2_GH
file = ReadFile(File=F, PerLineParse=True)
# import format: 0 agent index
# 1 body type
# 2 core point
# 3 forward vector
# 4 tips positions
# 5 tips connection topology
# tips topology: first index is the node, second index is the tip
# 
# ex:
# {0:2}
# (0) 11;3
# 
# means the tip 2 of node 0 is connected with the tip 3 of node 11
btparser = BodyTopologyParser(file=file)  # -> agent_id, body_type, body_core_point, body_forward_vector, tips_points, connection_topology
# 03_0_import bodies_types_extended
# 
# import bodies from Processing
# 
# code by Alessio Erioli
# 
# v 0.1
# 
# © Co-de-iT 2018 _ Creative Commons Attribution-NonCommercial-ShareAlike 4.0 International License
swatch = ColourSwatch(SwatchColor=RGB(255, 255, 255))
multiplication = Multiplication(A=btparser.body_forward_vector, B=Slider(7.825, range=1..10))
vdisex = VectorDisplayEx(Point=btparser.body_core_point, Vector=multiplication, Colour=swatch, Width=2)
pl = PlaneNormal(Origin=btparser.body_core_point, ZAxis=btparser.body_forward_vector)
ln = Line(StartPoint=btparser.body_core_point, EndPoint=btparser.tips_points)
dupln = RemoveDuplicateLines(Lines=flatten(ln), Tolerance=0.01)

# ---- group: clean line network for meshing/fabrication
crv = Curve(dupln)

# ---- group: body cores
pt = Point(btparser.body_core_point)  # disabled

# ---- group: tips points
pt_2 = Point(btparser.tips_points)  # disabled

# ----
# simple mesh pipe
number_slider = Slider(1, range=0..1)
join = JoinCurves(Curves=flatten(ln), Preserve=False)
mpipe = MeshPipe(Curve=join, Radius=number_slider, Accuracy=0.2, Rotation=0, Segments="4", Caps="1")
mjoin = MeshJoin(Meshes=mpipe)
previewmat = CustomPreviewMaterials(Geometry=mjoin, DiffuseColor=ColourSwatch(SwatchColor=RGB(145, 129, 35)))

# ----
# topology labels
expression = Expression(a=btparser.agent_id, b=btparser.body_type, Expression="Format(\"{0}_{1}\", a, b)")
tag = TextTag3D(
    Location=btparser.body_core_point,
    Text=expression,
    Size=Slider(1, range=0..10),
    Colour=ColourSwatch(SwatchColor=RGB(255, 255, 255)),
    Justification=7)

crv_2 = Curve(ln)

# ----
# line network
pshift = ShiftPaths(Data=btparser.connection_topology, Offset=-1)
lng = ListLength(List=pshift)
num = Number(lng)
bnd = Bounds(Numbers=flatten(num))
remap = RemapNumbers(Value=num, Source=bnd, Target=Domain(0, 1))  # -> Mapped, Clipped
gradient = Gradient(LowerLimit=0, UpperLimit=1, Parameter=remap.Mapped, stops=[0.0345: RGB(137, 205, 240), 0.98: RGB(14, 26, 76)])
previewlw = CustomPreviewLineweights(Geometry=crv_2, Shader=gradient, Thickness=Slider(3, range=1..5), Absolute=False)

bake = Button()
# bake lines in color
f_bakeatt = BakeAttributesEnhanced(obj=crv_2, layer="formation_lines", color=gradient, material=gradient, bake_iT=bake)  # -> info; inputs obj: GeometryBase, name: String, layer: String, color: Color, pWidth: Double, wires: Int32, group_n: Int32, group: Boolean, bake_iT: Boolean
#   port layer: Layer name for the object if the layer doesn't exist, it will be created
#   port bake_iT: Performs bake operation attach a button here and click to bake
# ---------- f_bakeatt: C# ----------
                                                                /*
    froGH - a sparse collection of (in)utilities for Grasshopper

    Bake Attributes ++
    Original Version Written by Giulio Piacentino - 2010 11 21 - for Grasshopper 0.8.002
    Enhanced by Co-de-iT (Alessio) - now bakes on chosen layer(s) and in groups

    froGH by Co-de-iT is licensed under a Creative Commons Attribution 4.0 International License.
    http://creativecommons.org/licenses/by/4.0/

    */

    initComp();

    if (bake_iT)
    {
      if(obj == null)
      {
        Print("No object to bake");
        return;
      }

      //Make new attribute to set name
      Rhino.DocObjects.ObjectAttributes att = new Rhino.DocObjects.ObjectAttributes();

      //Set object name
      if(!string.IsNullOrEmpty(name))
      {
        att.Name = name;
      }

      //Set color
      if(!color.IsEmpty)
      {
        att.ColorSource = Rhino.DocObjects.ObjectColorSource.ColorFromObject; //Make the color type "by object"
        att.ObjectColor = color;

        att.PlotColorSource = Rhino.DocObjects.ObjectPlotColorSource.PlotColorFromObject; //Make the plot color type "by object"
        att.PlotColor = color;
      }

      // Set group

      if(group)
      {
        doc.Groups.Add(Convert.ToString(group_n));
        att.AddToGroup(group_n);

      }

      //Set layer
      if(!string.IsNullOrEmpty(layer) && Rhino.DocObjects.Layer.IsValidName(layer))
      {
        //Get the current layer index
        Rhino.DocObjects.Tables.LayerTable layerTable = doc.Layers;
        int layerIndex = layerTable.Find(layer, true);

        if(layerIndex < 0) //This layer does not exist, we add it
        {
          Rhino.DocObjects.Layer onlayer = new Rhino.DocObjects.Layer(); //Make a new layer
          onlayer.Name = layer;

          layerIndex = layerTable.Add(onlayer); //Add the layer to the layer table
          if (layerIndex > -1) //We manged to add layer!
          {
            att.LayerIndex = layerIndex;
            Print("Added new layer to the document at position " + layerIndex + " named " + layer + ". ");
          } else
            Print("Layer did not add. Try cleaning up your layers."); //This never happened to me.
        }
        else
          att.LayerIndex = layerIndex; //We simply add to the existing layer
      }


      //Set plotweight
      if(pWidth > 0)
      {
        att.PlotWeightSource = Rhino.DocObjects.ObjectPlotWeightSource.PlotWeightFromObject;
        att.PlotWeight = pWidth;
      }


      //Set material
      bool materialByName = !string.IsNullOrEmpty(material as string);
      Rhino.Display.DisplayMaterial inMaterial = material as Rhino.Display.DisplayMaterial;
      if(material is Color)
      {
        inMaterial = new Rhino.Display.DisplayMaterial((Color) material);
      }
      if(material != null && inMaterial == null && !materialByName)
      {
        if(!(material is string))
        {
          try //We also resort to try with IConvertible
          {
            inMaterial = (Rhino.Display.DisplayMaterial) Convert.ChangeType(material, typeof(Rhino.Display.DisplayMaterial));
          }
          catch(InvalidCastException)
          {
          }
        }
      }
      if(inMaterial != null || materialByName)
      {
        string matName;

        if(!materialByName)
        {
          matName = string.Format("A:{0}-D:{1}-E:{2}-S:{3},{4}-T:{5}",
            Format(inMaterial.Ambient),
            Format(inMaterial.Diffuse),
            Format(inMaterial.Emission),
            Format(inMaterial.Specular),
            inMaterial.Shine.ToString(),
            inMaterial.Transparency.ToString()
            );
        }
        else
        {
          matName = (string) material;
        }

        int materialIndex = doc.Materials.Find(matName, true);
        if(materialIndex < 0 && !materialByName) //Material does not exist and we have its specs
        {
          materialIndex = doc.Materials.Add(); //Let's add it
          if(materialIndex > -1)
          {
            Print("Added new material at position " + materialIndex + " named \"" + matName + "\". ");
            Rhino.DocObjects.Material m = doc.Materials[materialIndex];
            m.Name = matName;
            m.AmbientColor = inMaterial.Ambient;
            m.DiffuseColor = inMaterial.Diffuse;
            m.EmissionColor = inMaterial.Emission;
            //m.ReflectionColor = no equivalent
            m.SpecularColor = inMaterial.Specular;
            m.Shine = inMaterial.Shine;
            m.Transparency = inMaterial.Transparency;
            //m.TransparentColor = no equivalent
            m.CommitChanges();

            att.MaterialSource = Rhino.DocObjects.ObjectMaterialSource.MaterialFromObject;
            att.MaterialIndex = materialIndex;
          }
          else
            Print("Material did not add. Try cleaning up your materials."); //This never happened to me.
        }
        else if(materialIndex < 0 && materialByName) //Material does not exist and we do not have its specs. We do nothing
        {
          Print("Warning: material name not found. I cannot set the source to this material name. Add a material with name: " + matName);
        }
        else
        {
          //If this material exists, we do not replace it!
          att.MaterialSource = Rhino.DocObjects.ObjectMaterialSource.MaterialFromObject;
          att.MaterialIndex = materialIndex;
        }
      }


      //Set wire density
      if(wires == -1 || wires > 0)
      {
        att.WireDensity = wires;
      }


      //Bake to the right type of object
      switch(obj.ObjectType)
      {
        case Rhino.DocObjects.ObjectType.Brep:
          doc.Objects.AddBrep(obj as Brep, att);
          break;
        case Rhino.DocObjects.ObjectType.Curve:
          doc.Objects.AddCurve(obj as Curve, att);
          break;
        case Rhino.DocObjects.ObjectType.Point:
          doc.Objects.AddPoint((obj as Rhino.Geometry.Point).Location, att);
          break;
        case Rhino.DocObjects.ObjectType.Surface:
          doc.Objects.AddSurface(obj as Surface, att);
          break;
        case Rhino.DocObjects.ObjectType.Mesh:
          doc.Objects.AddMesh(obj as Mesh, att);
          break;
        case Rhino.DocObjects.ObjectType.Extrusion:
          typeof(Rhino.DocObjects.Tables.ObjectTable).InvokeMember("AddExtrusion", BindingFlags.Instance | BindingFlags.InvokeMethod, null, doc.Objects, new object[]{obj, att});
          break;
        case Rhino.DocObjects.ObjectType.PointSet:
          doc.Objects.AddPointCloud(obj as Rhino.Geometry.PointCloud, att); //This is a speculative entry
          break;
        default:
          Print("The script does not know how to handle this type of geometry: " + obj.GetType().FullName);
          break;
      }
      Print("Added " + obj.GetType().Name);

    }
    else
    {
      Print("Inactive");
    }
    //obj_out = obj;
# ---------- f_bakeatt: C# additional code ----------
  void initComp(){

    Component.Name = "Bake Attributes Enhanced";
    Component.NickName = "f_BakeAtt++";
    Component.Description = "Bakes objects with attributes such as color, material, layer, object name, wire density. Option to bake in groups";
    Component.Params.Input[0].Name = "Object";
    Component.Params.Input[0].Description = "Object to bake";
    Component.Params.Input[1].Name = "Object name";
    Component.Params.Input[1].Description = "A custom name for the object";
    Component.Params.Input[2].Name = "Object Layer";
    Component.Params.Input[2].Description = "Layer name for the object\nif the layer doesn't exist, it will be created";
    Component.Params.Input[3].Name = "Object Color";
    Component.Params.Input[3].Description = "Color of baked object";
    Component.Params.Input[4].Name = "Print Width";
    Component.Params.Input[4].Description = "Print width";
    Component.Params.Input[5].Name = "Wire density";
    Component.Params.Input[5].Description = "Density of wires for display";
    Component.Params.Input[6].Name = "Material";
    Component.Params.Input[6].Description = "Object custom material";
    Component.Params.Input[7].Name = "Group Number";
    Component.Params.Input[7].Description = "Number of the group for the object\n(in case group option is active)";
    Component.Params.Input[8].Name = "Group Objects";
    Component.Params.Input[8].Description = "Bake objects in groups according to the group number for each object";
    Component.Params.Input[9].Name = "Bake it!";
    Component.Params.Input[9].Description = "Performs bake operation\nattach a button here and click to bake";
    Component.Params.Output[0].Name = "Info";
    Component.Params.Output[0].Description = "Info on the bake process/result";

  }

  static string Format(Color c)
  {
    return (new System.Text.StringBuilder("A")).Append(c.A.ToString()).Append("R").Append(c.R.ToString()).Append("G")
      .Append(c.G.ToString()).Append("B").Append(c.B.ToString()).ToString();
  }
# ---------- end f_bakeatt ----------

# ----
# tripod mesh pipe
crossref = CrossReference(ListA=btparser.tips_points, ListB=btparser.tips_points, CrossMode=5)  # -> ListA, ListB

# ---- group: insert core point
lng_2 = ListLength(List=crossref.ListA)
dup = DuplicateData(Data=btparser.body_core_point, Number=lng_2, Order=True)

# ----
merge = Merge(Data1=simplify(graft(crossref.ListA)), Data2=simplify(graft(dup)), Data3=simplify(graft(crossref.ListB)))
pline = PolyLine(Vertices=merge, Closed=False)
fillet = Fillet(Curve=pline, Radius=Slider(5.045, range=0..10))
pshift_2 = ShiftPaths(Data=fillet, Offset=-1)
mpipe_2 = MeshPipe(Curve=pshift_2, Radius=Slider(1, range=0..1), Accuracy=0.2, Rotation=0, Segments="4", Caps="1")
mjoin_2 = MeshJoin(Meshes=flatten(mpipe_2))
f_sbpath = SerialBranchPath(T=pshift_2, i=Slider(11, range=0..100))  # -> P, D; inputs T: tree, i: Int32
# ---------- f_sbpath: C# ----------
                                            /*
    froGH - a sparse collection of (in)utilities for Grasshopper

    Serial Branch Path
    code by Alessio Erioli

    froGH by Co-de-iT is licensed under a Creative Commons Attribution 4.0 International License.
    http://creativecommons.org/licenses/by/4.0/

    */

    initComp();


    if (T.BranchCount > 0){
      int ind = i % T.BranchCount;
      P = T.Path(ind);
      D = T.Branches[ind];
    }
# ---------- f_sbpath: C# additional code ----------
  void initComp(){
    Component.Name = "Serial Branch Path";
    Component.NickName = "f_SBPath";
    Component.Description = "Retrieves the data tree path and data for a specific branch serial index";
    Component.Params.Input[0].Name = "Tree";
    Component.Params.Input[0].Description = "the data tree";
    Component.Params.Input[1].Name = "index";
    Component.Params.Input[1].Description = "serial index of branch to sample";
    Component.Params.Output[0].Name = "Path";
    Component.Params.Output[0].Description = "the tree branch path";
    Component.Params.Output[1].Name = "Data";
    Component.Params.Output[1].Description = "the tree branch content";
  }
# ---------- end f_sbpath ----------
meshpreview = MeshPreview(Mesh=mjoin_2)
previewlw_2 = CustomPreviewLineweights(
    Geometry=f_sbpath.D,
    Shader=ColourSwatch(SwatchColor=RGB(255, 255, 255)),
    Thickness=Slider(5, range=0..10),
    Absolute=False)

# ----
# free/connected points
len = TextLength(Text=btparser.connection_topology)
ma = MassAddition(Input=len)  # -> Result, PartialResults
equals = Equality(FirstNumber=ma.Result, SecondNumber=0)  # -> Equality, Inequality
dispatch = Dispatch(List=graft(btparser.tips_points), DispatchPattern=equals.Equality)  # -> ListA, ListB
dispatch_2 = Dispatch(List=btparser.connection_topology, DispatchPattern=equals.Equality)  # -> ListA, ListB
topology_for_connected_points = Panel(dispatch_2.ListB)

# ---- group: free tips
pt_3 = Point(dispatch.ListA)

# ---- group: connected points
pt_4 = Point(dispatch.ListB)

# ----
msphere = MeshSphere(Base=pt_4, Radius=Slider(2.55, range=0..5), UCount="4", VCount="4")
mjoin_3 = MeshJoin(Meshes=flatten(msphere))
meshpreview_2 = MeshPreview(Mesh=mjoin_3)

panel_2 = Panel("""formation_tripods
formation_nodes""")
nodes = ColourSwatch(SwatchColor=RGB(255, 0, 0))
tripods = ColourSwatch(SwatchColor=RGB(255, 255, 255))
bake_2 = Button()
merge_2 = Merge(Data1=mjoin_2, Data2=mjoin_3)
merge_3 = Merge(Data1=tripods, Data2=nodes)
# bake geometry
f_bakeatt_2 = BakeAttributesEnhanced(obj=merge_2, layer=panel_2, material=merge_3, bake_iT=bake_2)  # -> info; inputs obj: GeometryBase, name: String, layer: String, color: Color, pWidth: Double, wires: Int32, group_n: Int32, group: Boolean, bake_iT: Boolean; same code as f_bakeatt

# ----
# connection directions
panel_3 = Panel(";")  # disabled
number_slider_2 = Slider(0.043, range=0..1)  # disabled
graft = GraftTree(Tree=pt_2, IncludeEmptyLists=True, IncludeNullItems=True)  # disabled
swatch_2 = ColourSwatch(SwatchColor=RGB(255, 187, 0))  # disabled

# ---- group: tips connection topology
split = TextSplit(Text=btparser.connection_topology, Separators=panel_3)  # -> simplify(Result); disabled

# ----
item = ListItem(List=split, Index=0, Wrap=True)  # -> simplify(Item), Item1; disabled

pshift_3 = ShiftPaths(Data=item.Item, Offset=-1)  # disabled

int = Integer(pshift_3)  # disabled
item_2 = ListItem(List=flatten(pt), Index=int, Wrap=True)  # -> simplify(Item); disabled
vec2pt = Vector2Pt(PointA=graft, PointB=item_2, Unitize=False)  # -> Vector, Length; disabled
multiplication_2 = Multiplication(A=vec2pt.Vector, B=number_slider_2)  # disabled
vdisex_2 = VectorDisplayEx(Point=graft, Vector=multiplication_2, Colour=swatch_2, Width=2)  # disabled

# ---- group: connected agents to each tip
ln_2 = Line(StartPoint=graft, EndPoint=item_2)  # disabled

# ==== cluster BodyTopologyParser: Parses a body topology file from Processing
file = ClusterInput()  # File to parse
# import format: 0 agent index
# 1 body type
# 2 core point
# 3 forward vector
# 4 > n-1 tips positions
# n tips connections
panel = Panel(" ")
split = TextSplit(Text=file, Separators=panel)  # -> simplify(Result)
cull_i = CullIndex(List=split, Indices="-1", Wrap=True)  # -> simplify(List)
item = ListItem(List=split, Index="-1", Wrap=True)
split_2 = SplitList(List=cull_i, Index="4")  # -> simplify(ListA), simplify(ListB)
split_3 = TextSplit(Text=item, Separators="_")
split_4 = TextSplit(Text=split_3, Separators=",")  # -> simplify(Result)
item_2 = ListItem(List=split_2.ListA, Index=0, Wrap=True)  # -> Item, Item1, Item2, Item3

# ---- group: connection topology
data = Data(split_4)

# ---- group: agent id
int = Integer(item_2.Item)

# ---- group: body type
int_2 = Integer(item_2.Item1)

# ---- group: body core
pt = Point(item_2.Item2)

# ---- group: forward vector
vec = Vector(item_2.Item3)

# ---- group: tip points
pt_2 = Point(split_2.ListB)

# ----
body_forward_vector = ClusterOutput(vec)
connection_topology = ClusterOutput(data)
agent_id = ClusterOutput(int)
body_type = ClusterOutput(int_2)
tips_points = ClusterOutput(pt_2)
body_core_point = ClusterOutput(pt)
