# Grasshopper definition 03_2_network iso.gh (Grasshopper 0.9.76)
# Copyright: Co-de-iT
# plug-ins: MarchingCubes, Human

crv = Curve([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])
bbox = BoundingBox(Content=crv, Plane=PlaneXY(0, 0, 0), UnionBox=True)  # -> Box, Box_2
boxprop = BoxProperties(Box=bbox.Box)  # -> Center, Diagonal, Area, Volume, Degeneracy

activate = BooleanToggle(False)
activate_2 = BooleanToggle(False)

# ----
# 03_2_network iso
# 
# isosurfacing strategy for line network - use this as a last resort for printing or for your own experiments
# 
# code by Alessio Erioli
# 
# v 0.1
# 
# © Co-de-iT 2018 _ Creative Commons Attribution-NonCommercial-ShareAlike 4.0 International License
curve_charge = CurveCharge(Curve=crv, Radius=Slider(4, range=0..10), ChargeStrengths=Slider(1, range=0..1))
number_slider = Slider(2, range=1..20)
cocoon = Cocoon(Charges=curve_charge, Iso=Slider(0.15, range=0..1), CellSize=number_slider, Execute=activate, Simple=False)  # -> Mesh, RefinementData
sampling_increment = Slider(0.25, range=0..1)
# cocoon isomesh
refine = Refine(
    RefinementData=cocoon.RefinementData,
    Samples=Slider(3, range=1..10),
    SampleSize=sampling_increment,
    SampleTolerance=Slider(0.25, range=0..1),
    LaplacianSmoothing=Slider(1, range=1..5),
    ValencePasses=Slider(1, range=1..10),
    SubD=Slider(1, range=1..3),
    Execute=activate_2)
mjoin = MeshJoin(Meshes=refine)
previewmat = CustomPreviewMaterials(Geometry=mjoin, DiffuseColor=RGB(255, 255, 255))

devec = DeconstructVector(Vector=boxprop.Diagonal)  # -> XComponent, YComponent, ZComponent
merge = Merge(Data1=devec.XComponent, Data2=devec.YComponent, Data3=devec.ZComponent)
expression = Expression(x=devec.XComponent, y=devec.YComponent, z=devec.ZComponent, s=number_slider, Expression="int(x/s*y/s*z/s)")
expression_2 = Expression(l=merge, s=number_slider, Expression="int(l/s)")
# NOTE: careful with Cocoon: for a smoother mesh you should increase the cell count, but isomeshing can take a while, especially when your cell number is very big (the smaller the cell size, the more the cells, the slower the algorithm). Look below to keep your cell count in check.
n_of_cells_total_x_y_z = Panel([expression, expression_2])
