# Grasshopper definition 03_3_turntable animation.gh (Grasshopper 0.9.76)
# Copyright: Co-de-iT
# plug-ins: horsterCameraControl

geo = Geometry([<mesh referenced from the Rhino model> x2])
xy = XYPlane(Origin=Point(0, 0, 0))
distance_multiplier = Slider(5.051, range=1..10)
lens_min = Panel("21")
lens_max = Panel("120")
lens = Slider(1, range=0..1)
direction = ValueList({"CCW": 0, "CW": 1}, selected="CCW")
adjust_start = Slider(0, range=0..1)
slide_camera_plane = Slider(0, range=-100..300)
slide_target_plane = Slider(0, range=-100..100)
activate_camera = BooleanToggle(True)
animation_slider = Slider(0, range=0..1)
merge = Merge(Data1=lens_min, Data2=lens_max)
bbox = BoundingBox(Content=geo, Plane=PlaneXY(0, 0, 0), UnionBox=True)  # -> Box, Box_2
num = Number(merge)
boxprop = BoxProperties(Box=bbox.Box)  # -> Center, Diagonal, Area, Volume, Degeneracy
devec = DeconstructVector(Vector=boxprop.Diagonal)  # -> XComponent, YComponent, ZComponent
interp = InterpolateData(Data=num, Parameter=lens, Interpolation=2)
max = Maximum(A=devec.XComponent, B=devec.YComponent)

# ---- group: compensate lens/distance
expression = Expression(d=max, dm=distance_multiplier, l=interp, lmin=lens_min, lMax=lens_max, Expression="d*dm*(l/((lMax+lmin)*0.5))")

# ----
lens_used = Panel(interp)
# 03_3_turntable animation
# 
# automate turntable animation with several options
# 
# code by Alessio Erioli
# 
# v 0.1
# 
# © Co-de-iT 2018 _ Creative Commons Attribution-NonCommercial-ShareAlike 4.0 International License
pl_origin = PlaneOrigin(Base=xy, Origin=boxprop.Center)
deplane = DeconstructPlane(Plane=pl_origin)  # -> Origin, XAxis, YAxis, ZAxis
amp = Amplitude(Vector=deplane.ZAxis, Amplitude=slide_camera_plane)
amp_2 = Amplitude(Vector=deplane.ZAxis, Amplitude=slide_target_plane)
move = Move(Geometry=pl_origin, Motion=amp)  # -> Geometry, Transform
move_2 = Move(Geometry=boxprop.Center, Motion=amp_2)  # -> Geometry, Transform
cir = Circle(Plane=move.Geometry, Radius=expression)
seam = Seam(Curve=reparameterize(cir), Seam=adjust_start)
flip = FlipCurve(Curve=seam)  # -> Curve, Flag
filter = StreamFilter(Gate=direction, Stream0=seam, Stream1=flip.Curve)
eval = EvaluateCurve(Curve=reparameterize(filter), Parameter=animation_slider)  # -> Point, Tangent, Angle
setcam = SetCamera(
    CameraLocation=eval.Point,
    TargetLocation=move_2.Geometry,
    LensLength=interp,
    UpDirection=deplane.ZAxis,
    Activate=activate_camera)
