# Grasshopper definition 03_5_network_nodes_AE.gh (Grasshopper 0.9.76)
# plug-ins: MeshEdit Components, Sandbox Topology, Human, Weaverbird, Starling, Kangaroo2 Components, Mesh Pipe

# plugins:
# 
# . sandbox topology
# . mesh edit 2
# . kangaroo
# 
# (some user objects are from froGH)
polygon_type = ValueList({"Bisymmetric Hendecahedron": 0, "Truncated Octahedron": 1, "Sphenoid Hendecahedron": 2}, selected="Sphenoid Hendecahedron")
polygon_type_2 = ValueList({"Bisymmetric Hendecahedron": 0, "Truncated Octahedron": 1, "Sphenoid Hendecahedron": 2}, selected="Bisymmetric Hendecahedron")
f_sphgen = SpaceFillingPolyhedraGenerator(type=polygon_type, scale=Slider(60, range=0..100))  # -> M, Poly; inputs P: Point3d, type: Int32, scale: Double
# ---------- f_sphgen: C# ----------
                                            /*
    froGH - a sparse collection of (in)utilities for Grasshopper

    Space-filling Polyhedra generator
    code by Alessio Erioli

    froGH by Co-de-iT is licensed under a Creative Commons Attribution 4.0 International License.
    http://creativecommons.org/licenses/by/4.0/

    */
    initComp();

    //Print("Hello " + Environment.UserName);
    //int vCount = RhinoDoc.ActiveDoc.NamedViews.Count;
    //Print(vCount.ToString());

    // __________________ autoList part __________________

    // variable for the list
    Grasshopper.Kernel.Special.GH_ValueList vList;
    // tries to cast input as list
    try{

      // if the list is not the first parameter then change Input[0] to the corresponding value
      vList = (Grasshopper.Kernel.Special.GH_ValueList) Component.Params.Input[1].Sources[0];
      // Print("value list connected");
      // check if the list must be created
      //if (vList.NickName != "dir type"){
      if (!vList.NickName.Equals("polygon type")){
        vList.ClearData();
        vList.ListItems.Clear();
        vList.NickName = "polygon type";
        var item1 = new Grasshopper.Kernel.Special.GH_ValueListItem("Bisymmetric Hendecahedron", "0");
        var item2 = new Grasshopper.Kernel.Special.GH_ValueListItem("Truncated Octahedron", "1");
        var item3 = new Grasshopper.Kernel.Special.GH_ValueListItem("Sphenoid Hendecahedron", "2");
        vList.ListItems.Add(item1);
        vList.ListItems.Add(item2);
        vList.ListItems.Add(item3);

        vList.ListItems[0].Value.CastTo(out type);
      }
    }
    catch{
      // handles anything that is not a value list
    }

    PolyHedra b;
    b = new PolyHedra(P, type, scale);
    M = b.mesh;
    Poly = b.fc;
# ---------- f_sphgen: C# additional code ----------
  void initComp(){
    Component.Name = "Space-filling polyhedra generator";
    Component.NickName = "f_SPHGen";
    Component.Description = "Creates a space filling polyhedra";

    Component.Params.Input[0].Name = "Base Point";
    Component.Params.Input[0].Description = "Base point for polyhedra";
    Component.Params.Input[1].Name = "Polyhedra type";
    Component.Params.Input[1].Description = "0 Bysimmetric Hendecahedron, 1 Truncated Octahedron, 2 Sphenoid Hendecahedron";
    Component.Params.Input[2].Name = "Scale";
    Component.Params.Input[2].Description = "Polyhedra scale (center on base point)";
    Component.Params.Output[0].Name = "Mesh";
    Component.Params.Output[0].Description = "Polyhedron as mesh";
    Component.Params.Output[1].Name = "Face polylines";
    Component.Params.Output[1].Description = "Polyhedron faces as polylines";
  }


  public class PolyHedra
  {

    public Point3d basePt;
    public Mesh mesh;
    public List<Polyline> fc;
    public int type;
    public double scale;

    public PolyHedra(Point3d basePt, int type, double scale)
    {
      this.basePt = basePt;
      this.type = type;
      this.scale = scale;
      fc = new List<Polyline>();
      switch (type){
        case 0:
          //mesh = BisymmetricHendec(basePt, scale, fc);
          mesh = BisymmetricHendec();
          break;
        case 1:
          mesh = TruncatedOct(basePt, scale, fc);
          break;
        case 2:
          mesh = SphenoidHendec(basePt, scale, fc);
          break;
        default:
          mesh = new Mesh();
          break;
      }
      getFacesPolylines();
    }

    Mesh BisymmetricHendec() {
      Mesh mesh = new Mesh();

      mesh.Vertices.Add(Point3d.Add(new Point3d(0, 0, 2), basePt));
      mesh.Vertices.Add(Point3d.Add(new Point3d(2, 1, 1), basePt));
      mesh.Vertices.Add(Point3d.Add(new Point3d(0, -1, 1), basePt));
      mesh.Vertices.Add(Point3d.Add(new Point3d(-2, 1, 1), basePt));
      mesh.Vertices.Add(Point3d.Add(new Point3d(0, 2, 0), basePt));
      mesh.Vertices.Add(Point3d.Add(new Point3d(1, -1, 0), basePt));
      mesh.Vertices.Add(Point3d.Add(new Point3d(-1, -1, 0), basePt));
      mesh.Vertices.Add(Point3d.Add(new Point3d(2, 1, -1), basePt));
      mesh.Vertices.Add(Point3d.Add(new Point3d(0, -1, -1), basePt));
      mesh.Vertices.Add(Point3d.Add(new Point3d(-2, 1, -1), basePt));
      mesh.Vertices.Add(Point3d.Add(new Point3d(0, 0, -2), basePt));

      mesh.Faces.AddFace(0, 3, 6, 2);
      mesh.Faces.AddFace(0, 2, 5, 1);
      mesh.Faces.AddFace(1, 5, 7);
      mesh.Faces.AddFace(7, 5, 8, 10);
      mesh.Faces.AddFace(10, 9, 6, 8);
      mesh.Faces.AddFace(8, 5, 2, 6);
      mesh.Faces.AddFace(6, 9, 3);
      mesh.Faces.AddFace(7, 4, 9, 10);
      mesh.Faces.AddFace(0, 3, 4, 1);
      mesh.Faces.AddFace(9, 4, 3);
      mesh.Faces.AddFace(7, 4, 1);

      mesh.UnifyNormals();

      mesh.Scale(scale);

      return mesh;
    }

    Mesh TruncatedOct(Point3d basePt, double scale, List<Polyline> fc) {
      Mesh mesh = new Mesh();

      mesh.Vertices.Add(Point3d.Add(new Point3d(0, -0.25, 0.5), basePt)); // A - 0
      mesh.Vertices.Add(Point3d.Add(new Point3d(-0.25, 0, 0.5), basePt)); // B - 1
      mesh.Vertices.Add(Point3d.Add(new Point3d(-0.5, 0, 0.25), basePt)); // C - 2
      mesh.Vertices.Add(Point3d.Add(new Point3d(-0.5, -0.25, 0), basePt)); // D - 3
      mesh.Vertices.Add(Point3d.Add(new Point3d(-0.25, -0.5, 0), basePt)); // E - 4
      mesh.Vertices.Add(Point3d.Add(new Point3d(0, -0.5, 0.25), basePt)); // F - 5
      mesh.Vertices.Add(Point3d.Add(new Point3d(0.25, 0, 0.5), basePt)); // G - 6
      mesh.Vertices.Add(Point3d.Add(new Point3d(0.5, 0, 0.25), basePt)); // H - 7
      mesh.Vertices.Add(Point3d.Add(new Point3d(0.5, -0.25, 0), basePt)); // I - 8
      mesh.Vertices.Add(Point3d.Add(new Point3d(0.25, -0.5, 0), basePt)); // J - 9

      mesh.Vertices.Add(Point3d.Add(new Point3d(0, 0.25, 0.5), basePt)); // K - 10
      mesh.Vertices.Add(Point3d.Add(new Point3d(-0.5, 0.25, 0), basePt)); // L - 11
      mesh.Vertices.Add(Point3d.Add(new Point3d(-0.25, 0.5, 0), basePt)); // M  - 12
      mesh.Vertices.Add(Point3d.Add(new Point3d(0, 0.5, 0.25), basePt)); // N - 13
      mesh.Vertices.Add(Point3d.Add(new Point3d(0.5, 0.25, 0), basePt)); // O - 14
      mesh.Vertices.Add(Point3d.Add(new Point3d(0.25, 0.5, 0), basePt)); // P - 15

      mesh.Vertices.Add(Point3d.Add(new Point3d(0, -0.25, -0.5), basePt)); // Q - 16
      mesh.Vertices.Add(Point3d.Add(new Point3d(-0.25, 0, -0.5), basePt)); // R - 17
      mesh.Vertices.Add(Point3d.Add(new Point3d(-0.5, 0, -0.25), basePt)); // S - 18
      mesh.Vertices.Add(Point3d.Add(new Point3d(0, -0.5, -0.25), basePt)); // T - 19
      mesh.Vertices.Add(Point3d.Add(new Point3d(0.25, 0, -0.5), basePt)); // U - 20
      mesh.Vertices.Add(Point3d.Add(new Point3d(0.5, 0, -0.25), basePt)); // V - 21
      mesh.Vertices.Add(Point3d.Add(new Point3d(0, 0.25, -0.5), basePt)); // W - 22
      mesh.Vertices.Add(Point3d.Add(new Point3d(0, 0.5, -0.25), basePt)); // Z - 23

      // hex faces
      mesh.Faces.AddFace(0, 1, 2, 5);
      mesh.Faces.AddFace(5, 2, 3, 4); // full face: 0, 1, 2, 3, 4, 5
      mesh.Faces.AddFace(5, 7, 6, 0);
      mesh.Faces.AddFace(5, 9, 8, 7); // full face: 5, 9, 8, 7, 6, 0
      mesh.Faces.AddFace(7, 13, 10, 6);
      mesh.Faces.AddFace(7, 14, 15, 13);
      mesh.Faces.AddFace(13, 2, 1, 10);
      mesh.Faces.AddFace(13, 12, 11, 2);
      mesh.Faces.AddFace(19, 21, 8, 9);
      mesh.Faces.AddFace(19, 16, 20, 21);
      mesh.Faces.AddFace(21, 23, 15, 14);
      mesh.Faces.AddFace(21, 20, 22, 23);
      mesh.Faces.AddFace(23, 18, 11, 12);
      mesh.Faces.AddFace(23, 22, 17, 18);
      mesh.Faces.AddFace(18, 19, 4, 3);
      mesh.Faces.AddFace(18, 17, 16, 19);
      // quad faces
      mesh.Faces.AddFace(0, 6, 10, 1); // top
      mesh.Faces.AddFace(16, 20, 22, 17); // bottom
      mesh.Faces.AddFace(8, 21, 14, 7); // E
      mesh.Faces.AddFace(15, 23, 12, 13); // N
      mesh.Faces.AddFace(11, 18, 3, 2); // W
      mesh.Faces.AddFace(4, 19, 9, 5); // S

      mesh.UnifyNormals();
      mesh.Scale(scale);

      return mesh;
    }

    Mesh SphenoidHendec(Point3d basePt, double scale, List<Polyline> fc)
    {
      Mesh mesh = new Mesh();

      mesh.Vertices.Add(Point3d.Add(new Point3d(13.0 / 7.0, 3 * Math.Sqrt(3) / 7, 1), basePt)); // A - 0
      mesh.Vertices.Add(Point3d.Add(new Point3d(1, Math.Sqrt(3), 0), basePt)); // B - 1
      mesh.Vertices.Add(Point3d.Add(new Point3d(2, Math.Sqrt(3), 0.5), basePt)); // C - 2
      mesh.Vertices.Add(Point3d.Add(new Point3d(2.5, Math.Sqrt(3) / 2, 0), basePt)); // D - 3
      mesh.Vertices.Add(Point3d.Add(new Point3d(2.25, Math.Sqrt(3) / 4, 0.5), basePt)); // E - 4
      mesh.Vertices.Add(Point3d.Add(new Point3d(2, 0, 0), basePt)); // F - 5
      mesh.Vertices.Add(Point3d.Add(new Point3d(0, 0, 0.5), basePt)); // G - 6
      mesh.Vertices.Add(Point3d.Add(new Point3d(2, Math.Sqrt(3), -0.5), basePt)); // H - 7
      mesh.Vertices.Add(Point3d.Add(new Point3d(2.25, Math.Sqrt(3) / 4, -0.5), basePt)); // J - 8
      mesh.Vertices.Add(Point3d.Add(new Point3d(0, 0, -0.5), basePt)); // K - 9
      mesh.Vertices.Add(Point3d.Add(new Point3d(13.0 / 7.0, 3 * Math.Sqrt(3) / 7, -1), basePt)); // L - 10

      // quad faces
      mesh.Faces.AddFace(0, 6, 5, 4); // A G F E
      mesh.Faces.AddFace(0, 2, 1, 6); // A C B G
      mesh.Faces.AddFace(0, 4, 3, 2); // A E D C
      mesh.Faces.AddFace(5, 9, 10, 8); // F K L J
      mesh.Faces.AddFace(7, 1, 9, 10); // H B K L
      mesh.Faces.AddFace(7, 10, 8, 3); // H L J D
      mesh.Faces.AddFace(4, 5, 8, 3); // E F J D

      // tri faces
      mesh.Faces.AddFace(6, 9, 5); // G K F
      mesh.Faces.AddFace(6, 1, 9); // G B K
      mesh.Faces.AddFace(2, 3, 7); // C D H
      mesh.Faces.AddFace(2, 7, 1); // C H B

      mesh.UnifyNormals();
      mesh.Scale(scale);

      return mesh;
    }

    public void getFacesPolylines(){
      Polyline ff = new Polyline();
      for (int i = 0; i < mesh.Faces.Count; i++){
        ff = new Polyline();
        Point3f[] pf = new Point3f[4];
        mesh.Faces.GetFaceVertices(i, out pf[0], out pf[1], out pf[2], out pf[3]);
        for (int j = 0; j < pf.Length; j++){
          ff.Add(pf[j].X, pf[j].Y, pf[j].Z);
        }
        ff.Add(pf[0].X, pf[0].Y, pf[0].Z); // adds again first point to generate a closed polyline
        fc.Add(ff);
      }
    }
  }
# ---------- end f_sphgen ----------
f_sphgen_2 = SpaceFillingPolyhedraGenerator(type=polygon_type_2, scale=Slider(60, range=0..100))  # -> M, Poly; inputs P: Point3d, type: Int32, scale: Double; same code as f_sphgen
bbox = BoundingBox(Content=f_sphgen_2.M, Plane=PlaneXY(0, 0, 0))  # -> Box, Box_2
# small network
# average network
pop3d = Populate3D(Region=bbox.Box, Count=Slider(100, range=10..100), Seed=1)
explode = Explode(Curve=f_sphgen.Poly, Recursive=True)  # -> flatten(Segments), Vertices
minc = MeshInclusion(Mesh=f_sphgen_2.M, Point=pop3d, Strict=False)
case = ValueList({"polyhedra": 0, "connected points": 1, "custom network": 2}, selected="custom network")
clean = CleanTree(RemoveNulls=True, RemoveInvalid=True, RemoveEmpty=False, Tree=explode.Segments)
dispatch = Dispatch(List=pop3d, DispatchPattern=minc)  # -> ListA, ListB
prox = Proximity3D(Points=dispatch.ListA, Group="4", MinRadius=Slider(20, range=10..100))  # -> flatten(Links), Topology

crv = Curve([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])
crv_2 = Curve([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])
# big network
crv_3 = Curve([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])

# ----
# 03_5_network_nodes_AE
# 
# Transforms line network in nodes-rods structure
# 
# code by Alessio Erioli
# 
# v 0.1
# 
# © Co-de-iT 2018 _ Creative Commons Attribution-NonCommercial-ShareAlike 4.0 International License
filter = StreamFilter(Gate=case, Stream0=clean, Stream1=prox.Links, Stream2=crv)

# ---- group: clean line network
line = Line(filter)

# ----
dupln = RemoveDuplicateLines(Lines=line, Tolerance=0.01)
curvepoint = PointOnCurve(dupln, parameter=0.5)
avr = Average(Input=curvepoint)
scale = Scale(Geometry=dupln, Center=avr, Factor=Slider(5, range=1..5))  # -> Geometry, Transform
line_topo = LineTopology(ListOfLines=scale.Geometry, Tolerance=0.001)  # -> ListOfPoints, LinePointStructure, PointPointStructure, PointLineStructure
node_index = Slider(0.256, range=0..1)
lng = ListLength(List=line_topo.ListOfPoints)  # -> expr("x-1", Length)
multiplication = Multiplication(A=node_index, B=lng)
int = Integer(multiplication)
current_index = Panel(int)
f_sbpath = SerialBranchPath(T=line_topo.PointPointStructure, i=int)  # -> P, D; inputs T: tree, i: Int32
# ---------- f_sbpath: C# ----------
                                            /*
    froGH - a sparse collection of (in)utilities for Grasshopper

    Serial Branch Path
    code by Alessio Erioli

    froGH by Co-de-iT is licensed under a Creative Commons Attribution 4.0 International License.
    http://creativecommons.org/licenses/by/4.0/

    */

    initComp();


    if (T.BranchCount > 0){
      int ind = i % T.BranchCount;
      P = T.Path(ind);
      D = T.Branches[ind];
    }
# ---------- f_sbpath: C# additional code ----------
  void initComp(){
    Component.Name = "Serial Branch Path";
    Component.NickName = "f_SBPath";
    Component.Description = "Retrieves the data tree path and data for a specific branch serial index";
    Component.Params.Input[0].Name = "Tree";
    Component.Params.Input[0].Description = "the data tree";
    Component.Params.Input[1].Name = "index";
    Component.Params.Input[1].Description = "serial index of branch to sample";
    Component.Params.Output[0].Name = "Path";
    Component.Params.Output[0].Description = "the tree branch path";
    Component.Params.Output[1].Name = "Data";
    Component.Params.Output[1].Description = "the tree branch content";
  }
# ---------- end f_sbpath ----------
nodes = ValueList({"single node": 0, "full structure": 1}, selected="full structure")
item = ListItem(List=line_topo.ListOfPoints, Index=int, Wrap=True)
item_2 = ListItem(List=line_topo.ListOfPoints, Index=f_sbpath.D, Wrap=True)
item_3 = ListItem(List=line_topo.ListOfPoints, Index=line_topo.PointPointStructure, Wrap=True)
ln = Line(StartPoint=graft(line_topo.ListOfPoints), EndPoint=item_3)
ln_2 = Line(StartPoint=item, EndPoint=item_2)

# ---- group: nodes/points
filter_2 = StreamFilter(Gate=nodes, Stream0=item, Stream1=graft(line_topo.ListOfPoints))

# ---- group: lines/struts
filter_3 = StreamFilter(Gate=nodes, Stream0=ln_2, Stream1=ln)

# ----
strut_radius = Slider(0.9, range=0..1)
offset_from_center = Slider(7, range=0..20)
number_slider = Slider(10, range=0..10)
corner_spike = Slider(3, range=0..10)
depth = Slider(-5, range=-5..10)
arm_extension = Slider(7, range=0..10)
inside_crease = Slider(0.999, range=0.001..0.999)
outer_crease = Slider(0.001, range=0.001..0.499)
inner_crease = Slider(0.999, range=0.5..0.999)
arm_wrap_thickness = Slider(1, range=0.1..1)

compensation = Panel("1.06")
struts = Curve(filter_3)
multiplication_2 = Multiplication(A=strut_radius, B=compensation)
rev = Reverse(Vector=struts)
eval = EvaluateLength(Curve=struts, Length=offset_from_center, Normalized=False)  # -> Point, Tangent, Parameter
addition = Addition(A=multiplication_2, B=arm_wrap_thickness)
ma = MassAddition(Input=rev)  # -> Result, PartialResults
pframe = PerpFrame(Curve=struts, Parameter=eval.Parameter)
unit = UnitVector(Vector=ma.Result)
polygon = Polygon(Plane=pframe, Radius=addition, Segments=number_slider, FilletRadius=0)  # -> Polygon, Length
polygon_2 = Polygon(Plane=pframe, Radius=multiplication_2, Segments=number_slider, FilletRadius=0)  # -> Polygon, Length
multiplication_3 = Multiplication(A=unit, B=corner_spike)
disc = Discontinuity(Curve=polygon.Polygon, Level=1)  # -> Points, Parameters
deplane = DeconstructPlane(Plane=pframe)  # -> Origin, XAxis, YAxis, ZAxis
pshift = ShiftPaths(Data=disc.Points, Offset=-1)
move = Move(Geometry=filter_2, Motion=multiplication_3)  # -> Geometry, Transform
merge = Merge(Data1=move.Geometry, Data2=pshift)
multiplication_4 = Multiplication(A=deplane.ZAxis, B=arm_extension)
multiplication_5 = Multiplication(A=deplane.ZAxis, B=depth)
move_2 = Move(Geometry=polygon.Polygon, Motion=multiplication_4)  # -> Geometry, Transform
move_3 = Move(Geometry=polygon_2.Polygon, Motion=multiplication_4)  # -> Geometry, Transform

# ---- group: node body
convexhull = _3DConvexHull(Points=merge)

# ----
struts_end_offset = Slider(0.204, range=0..1)
addition_2 = Addition(A=depth, B=arm_extension, C=struts_end_offset)
multiplication_6 = Multiplication(A=deplane.ZAxis, B=addition_2)
move_4 = Move(Geometry=deplane.Origin, Motion=multiplication_6)  # -> flatten(Geometry), Transform
crv_4 = Curve(graft(scale.Geometry))
crv_cp = CurveClosestPoint(Point=move_4.Geometry, Curve=crv_4)  # -> Point, Parameter, Distance
item_4 = ListItem(List=line_topo.LinePointStructure, Index=0, Wrap=True)  # -> Item, Item1
smaller = SmallerThan(FirstNumber=crv_cp.Distance, SecondNumber="0.01")  # -> SmallerThan, OrEqualTo
dispatch_2 = Dispatch(List=crv_cp.Point, DispatchPattern=smaller.SmallerThan)  # -> ListA, ListB
pt = Point(dispatch_2.ListA)
pline = PolyLine(Vertices=pt, Closed=False)
len = Length(Curve=pline)
expression = Expression(x=item_4.Item, y=item_4.Item1, z=len, Expression="Format(\"{0}-{1} : length {2}\", x, y, round(z,2))")
curvepoint_2 = PointOnCurve(pline, parameter=0.5)
tag = TextTag3D(
    Location=curvepoint_2,
    Text=expression,
    Size=Slider(1.5, range=1..5),
    Colour=ColourSwatch(SwatchColor=RGB(84, 84, 84)),
    Justification=5)

move_5 = Move(Geometry=move_3.Geometry, Motion=multiplication_5)  # -> Geometry, Transform
disc_2 = Discontinuity(Curve=move_2.Geometry, Level=1)  # -> Points, Parameters
disc_3 = Discontinuity(Curve=move_3.Geometry, Level=1)  # -> Points, Parameters
disc_4 = Discontinuity(Curve=move_3.Geometry, Level=1)  # -> Points, Parameters
disc_5 = Discontinuity(Curve=move_5.Geometry, Level=1)  # -> Points, Parameters
vec2pt = Vector2Pt(PointA=disc_2.Points, PointB=disc_3.Points, Unitize=False)  # -> Vector, Length
avr_2 = Average(Input=disc_5.Points)
vec2pt_2 = Vector2Pt(PointA=disc_2.Points, PointB=disc_4.Points, Unitize=False)  # -> Vector, Length
multiplication_7 = Multiplication(A=vec2pt.Vector, B=inner_crease)
pshift_2 = ShiftPaths(Data=avr_2, Offset=-1)
multiplication_8 = Multiplication(A=vec2pt_2.Vector, B=outer_crease)
scale_2 = Scale(Geometry=move_5.Geometry, Center=pshift_2, Factor=inside_crease)  # -> Geometry, Transform

node_tag_offset = Slider(12.059, range=0..30)
multiplication_9 = Multiplication(A=simplify(unit), B=node_tag_offset)
multiplication_10 = Multiplication(A=simplify(unit), B=node_tag_offset)
move_6 = Move(Geometry=graft(line_topo.ListOfPoints), Motion=multiplication_9)  # -> Geometry, Transform
pl = PlaneNormal(Origin=move_6.Geometry, ZAxis=multiplication_10)  # -> flatten(Plane)
Z = UnitZ(Factor=1)
align = AlignPlane(Plane=pl, Direction=Z)  # -> Plane, Angle
# node tags
prot = RotatePlane(Plane=align.Plane, Angle="Pi*-.5")
lng_2 = ListLength(List=line_topo.ListOfPoints)
series = Series(Start=0, Step=1, Count=lng_2)
swatch = ColourSwatch(SwatchColor=RGB(0, 0, 0))
int_2 = Integer(series)
tag_2 = TextTag3D(Location=prot, Text=int_2, Size=Slider(3, range=1..5), Colour=swatch, Justification=5)

toggle = BooleanToggle(True)
move_7 = Move(Geometry=disc_2.Points, Motion=multiplication_8)  # -> Geometry, Transform
move_8 = Move(Geometry=disc_2.Points, Motion=multiplication_7)  # -> Geometry, Transform
disc_6 = Discontinuity(Curve=scale_2.Geometry, Level=1)  # -> Points, Parameters
disc_7 = Discontinuity(Curve=polygon.Polygon, Level=1)  # -> Points, Parameters
disc_8 = Discontinuity(Curve=move_2.Geometry, Level=1)  # -> Points, Parameters
disc_9 = Discontinuity(Curve=move_3.Geometry, Level=1)  # -> Points, Parameters
disc_10 = Discontinuity(Curve=move_5.Geometry, Level=1)  # -> Points, Parameters
f_mbridge = MeshBridge(Pa=disc_7.Points, Pb=disc_8.Points, S="1", W=toggle)  # -> M; inputs Pa: list of Point3d, Pb: list of Point3d, S: Int32, W: Boolean
# ---------- f_mbridge: C# ----------
           /*
    froGH - a sparse collection of (in)utilities for Grasshopper

    Mesh Bridge

    code by Alessio Erioli

    froGH by Co-de-iT is licensed under a Creative Commons Attribution 4.0 International License.
    http://creativecommons.org/licenses/by/4.0/

    */

    initComp();

    Mesh mesh = new Mesh();
    Mesh mFace = new Mesh();
    if (Pa.Count != Pb.Count) {
      Print("Pa and Pb MUST have the same number of points");
    }else{
      Point3d[][] pts = new Point3d[S + 1][];
      pts[0] = Pa.ToArray();
      pts[S] = Pb.ToArray();
      for (int i = 1; i < S; i++){
        pts[i] = new Point3d[Pa.Count];
        for (int j = 0; j < Pa.Count; j++){
          Vector3d v = Vector3d.Subtract((Vector3d) Pb[j], (Vector3d) Pa[j]);
          v = Vector3d.Divide(v, S);
          pts[i][j] = Point3d.Add(pts[i - 1][j], v);
        }
      }

      for (int i = 0; i < pts.Length - 1; i++){

        for(int j = 0; j < pts[i].Length; j++){
          mFace = new Mesh();
          int ind = (j + 1) % pts[i].Length;
          mFace.Vertices.Add(pts[i][j]);
          mFace.Vertices.Add(pts[i][ind]);
          mFace.Vertices.Add(pts[i + 1][ind]);
          mFace.Vertices.Add(pts[i + 1][j]);
          mFace.Faces.AddFace(0, 1, 2, 3);
          mesh.Append(mFace);
        }

      }
    }
    if(mesh != null && W) mesh.Weld(0.01);
    M = mesh;
# ---------- f_mbridge: C# additional code ----------
  void initComp(){
    Component.Name = "Mesh Bridge";
    Component.NickName = "f_MBridge";
    Component.Description = "Builds a Mesh Bridge between lists of points";
    Component.Params.Input[0].Name = "Points A";
    Component.Params.Input[0].Description = "the first set of points";
    Component.Params.Input[1].Name = "Points B";
    Component.Params.Input[1].Description = "the second set of points";
    Component.Params.Input[2].Name = "Subdivisions";
    Component.Params.Input[2].Description = "n. of subdivisions";
    Component.Params.Input[3].Name = "Wrap";
    Component.Params.Input[3].Description = "consider points as a closed loop (boolean)";
    Component.Params.Output[0].Name = "Mesh";
    Component.Params.Output[0].Description = "The output Mesh";
  }
# ---------- end f_mbridge ----------
f_mbridge_2 = MeshBridge(Pa=disc_2.Points, Pb=move_7.Geometry, S="1", W=toggle)  # -> M; inputs Pa: list of Point3d, Pb: list of Point3d, S: Int32, W: Boolean; same code as f_mbridge
f_mbridge_3 = MeshBridge(Pa=move_7.Geometry, Pb=move_8.Geometry, S="1", W=toggle)  # -> M; inputs Pa: list of Point3d, Pb: list of Point3d, S: Int32, W: Boolean; same code as f_mbridge
f_mbridge_4 = MeshBridge(Pa=move_8.Geometry, Pb=disc_3.Points, S="1", W=toggle)  # -> M; inputs Pa: list of Point3d, Pb: list of Point3d, S: Int32, W: Boolean; same code as f_mbridge
f_mbridge_5 = MeshBridge(Pa=disc_9.Points, Pb=disc_10.Points, S="1", W=toggle)  # -> M; inputs Pa: list of Point3d, Pb: list of Point3d, S: Int32, W: Boolean; same code as f_mbridge
f_mbridge_6 = MeshBridge(Pa=disc_5.Points, Pb=disc_6.Points, S="1", W=toggle)  # -> M; inputs Pa: list of Point3d, Pb: list of Point3d, S: Int32, W: Boolean; same code as f_mbridge

# ---- group: inside bottom face
slstarmesh = SlStarMesh(Polyline=scale_2.Geometry)

# ---- group: inside crease ring
pshift_3 = ShiftPaths(Data=f_mbridge_6, Offset=-1)

# ---- group: outer arm
pshift_4 = ShiftPaths(Data=f_mbridge, Offset=-1)

# ---- group: outside crease - external
pshift_5 = ShiftPaths(Data=f_mbridge_2, Offset=-1)

# ---- group: outside ring
pshift_6 = ShiftPaths(Data=f_mbridge_3, Offset=-1)

# ---- group: outside crease - internal
pshift_7 = ShiftPaths(Data=f_mbridge_4, Offset=-1)

# ---- group: inner arm
pshift_8 = ShiftPaths(Data=f_mbridge_5, Offset=-1)

# ----
rev_2 = Reverse(Vector=multiplication_10)
multiplication_11 = Multiplication(A=simplify(multiplication_9), B=Slider(0.95, range=0..1))
multiplication_12 = Multiplication(A=simplify(multiplication_9), B=Slider(0.05, range=0..1))
move_9 = Move(Geometry=graft(line_topo.ListOfPoints), Motion=multiplication_11)  # -> Geometry, Transform
# struts tags + lengths
move_10 = Move(Geometry=graft(line_topo.ListOfPoints), Motion=multiplication_12)  # -> Geometry, Transform

# ---- group: struts display
mpipe = MeshPipe(Curve=pline, Radius=strut_radius, Accuracy=0.2, Rotation=0, Segments=Slider(10, range=4..10), Caps="1")
previewmat = CustomPreviewMaterials(Geometry=mpipe, DiffuseColor=ColourSwatch(SwatchColor=RGB(97, 97, 97)))

# ----
ln_3 = Line(StartPoint=move_9.Geometry, EndPoint=move_10.Geometry)
previewlw = CustomPreviewLineweights(Geometry=ln_3, Shader=swatch, Absolute=False)
elements_and_lengths = Panel(expression)

# ---- group: cull lateral faces from node body
scale_3 = Scale(Geometry=polygon.Polygon, Center=pframe, Factor="0.99")  # -> Geometry, Transform
disc_11 = Discontinuity(Curve=scale_3.Geometry, Level=1)  # -> Points, Parameters
line_2 = LineSDL(Start=disc_11.Points, Direction=graft(deplane.ZAxis), Length="0.01")

# ----
pshift_9 = ShiftPaths(Data=line_2, Offset=-1)

# ---- group: cull lateral faces from node body (continued)
ext = ExtendCurve(Curve=pshift_9, Type=0, Start="0.01", End="0")
mcx = MeshCurve(Mesh=convexhull, Curve=ext)  # -> Points, Faces

# ----
pshift_10 = ShiftPaths(Data=mcx.Faces, Offset=-1)

# ---- group: cull lateral faces from node body (continued)
deletef = DeleteFaces(Mesh=convexhull, Indices=pshift_10)

# ----
merge_2 = Merge(
    Data1=deletef,
    Data2=pshift_4,
    Data3=slstarmesh,
    Data4=pshift_3,
    Data5=pshift_5,
    Data6=pshift_6,
    Data7=pshift_7,
    Data8=pshift_8)

# ---- group: node generation & display
wbjoin = WeaverbirdsJoinMeshesAndWeld(Mesh=merge_2, Weld=True)
unifynormals = MeshUnifyNormals(Mesh=wbjoin)
wbcatmullclark = WeaverbirdsCatmullClarkSubdivision(MeshCurves=unifynormals, Level=2, SmoothNakedEdges=1)
previewmat_2 = CustomPreviewMaterials(Geometry=wbcatmullclark, DiffuseColor=RGB(255, 255, 255))

# ----
previewlw_2 = CustomPreviewLineweights(Geometry=wbcatmullclark, Shader=ColourSwatch(SwatchColor=RGBA(0, 0, 0, 23)), Absolute=False)
