# Grasshopper definition 03_import bodies_types_extended.gh (Grasshopper 0.9.76)
# Copyright: Co-de-iT
# plug-ins: Exoskeleton2, Human, Weaverbird, Kangaroo2 Components, Mesh Pipe, IntraLattice

F = File("C:\Users\Alessio\Documents\GitHub\DBD_2018\workflow\P5_2_GH\1696_struct_topoXt.txt")
panel = Panel(F)
# drag here the .txt file from
# 
# P5_2_GH
file = ReadFile(File=F, PerLineParse=True)
# import format: 0 agent index
# 1 body type
# 2 core point
# 3 forward vector
# 4 tips positions
# 5 tips connection topology
btparser = BodyTopologyParser(file=file)  # -> agent_id, body_type, body_core_point, body_forward_vector, tips_points, connection_topology
# tips topology: first index is the node, second index is the tip
# 
# ex:
# {0:2}
# (0) 11;3
# 
# means the tip 2 of node 0 is connected with the tipo 3 of node 11
panel_2 = Panel(btparser.body_core_point)
panel_3 = Panel(btparser.tips_points)
# <title>
# 
# <description>
# 
# code by <author>
# 
# v <version>
# 
# © Co-de-iT 2018 _ Creative Commons Attribution-NonCommercial-ShareAlike 4.0 International License
swatch = ColourSwatch(SwatchColor=RGB(255, 255, 255))
panel_4 = Panel(btparser.connection_topology)
multiplication = Multiplication(A=btparser.body_forward_vector, B=Slider(7.825, range=1..10))
vdisex = VectorDisplayEx(Point=btparser.body_core_point, Vector=multiplication, Colour=swatch, Width=2)
pl = PlaneNormal(Origin=btparser.body_core_point, ZAxis=btparser.body_forward_vector)
ln = Line(StartPoint=btparser.body_core_point, EndPoint=btparser.tips_points)

# ----
# connection directions
panel_5 = Panel(";")
split = TextSplit(Text=btparser.connection_topology, Separators=panel_5)  # -> simplify(Result)
item = ListItem(List=split, Index=0, Wrap=True)  # -> Item, Item1
int = Integer(item.Item)
item_2 = ListItem(List=flatten(btparser.body_core_point), Index=int, Wrap=True)
pshift = ShiftPaths(Data=item_2, Offset=-1)
graft = GraftTree(Tree=btparser.tips_points, IncludeEmptyLists=True, IncludeNullItems=True)
vec2pt = Vector2Pt(PointA=graft, PointB=pshift, Unitize=False)  # -> Vector, Length
multiplication_2 = Multiplication(A=vec2pt.Vector, B=Slider(0.043, range=0..1))
vdisex_2 = VectorDisplayEx(Point=graft, Vector=multiplication_2, Colour=ColourSwatch(SwatchColor=RGB(255, 187, 0)), Width=2)

dupln = RemoveDuplicateLines(Lines=flatten(ln), Tolerance=0.01)
panel_6 = Panel(split)

# ---- group: clean line network for meshing/fabrication
crv = Curve(dupln)

# ----
# exoskeleton
number_slider = Slider(6, range=0..10)
number_slider_2 = Slider(1, range=0..2)
dupln_2 = RemoveDuplicateLines(Lines=ln, Tolerance=0.01)  # disabled
exow = ExoWireframe(
    Lines=simplify(dupln_2),
    Sides=number_slider,
    StartRadius=number_slider_2,
    EndRadius=number_slider_2,
    NodeDepth=Slider(5, range=0..10),
    Division=Slider(100, range=1..100),
    Open=Toggle(True))
mjoin = MeshJoin(Meshes=flatten(exow))
wbloop = WeaverbirdsLoopSubdivision(MeshCurves=mjoin, Level="1", SmoothNakedEdges=1)
# warning: exoskeleton works only for
# a limited number of bodies at a time
# (use sub-lists)
previewmat = CustomPreviewMaterials(Geometry=wbloop, DiffuseColor=RGB(255, 255, 255))
previewlw = CustomPreviewLineweights(Geometry=wbloop, Shader=ColourSwatch(SwatchColor=RGBA(0, 0, 0, 0)), Absolute=False)

# ---- group: connected agents to each tip
ln_2 = Line(StartPoint=graft, EndPoint=pshift)

# ----
# line network
lng = ListLength(List=flatten(btparser.agent_id))  # -> expr("x-1", Length)
range = Range(Domain=Domain(0, 1), Steps=lng)  # -> graft(Range)
gradient = Gradient(LowerLimit=0, UpperLimit=1, Parameter=range, stops=[0.0345: RGB(137, 205, 240), 0.98: RGB(14, 26, 76)])
previewlw_2 = CustomPreviewLineweights(Geometry=ln, Shader=gradient, Thickness=Slider(3, range=1..5), Absolute=False)

# ----
# simple mesh pipe
number_slider_3 = Slider(1, range=0..1)
join = JoinCurves(Curves=flatten(ln), Preserve=False)
mpipe = MeshPipe(Curve=join, Radius=number_slider_3, Accuracy=0.2, Rotation=0, Segments="4", Caps="1")
mjoin_2 = MeshJoin(Meshes=mpipe)
previewmat_2 = CustomPreviewMaterials(Geometry=mjoin_2, DiffuseColor=ColourSwatch(SwatchColor=RGB(145, 129, 35)))

# ----
# topology labels
expression = Expression(a=btparser.agent_id, b=btparser.body_type, Expression="Format(\"{0}_{1}\", a, b)")
tag = TextTag3D(
    Location=btparser.body_core_point,
    Text=expression,
    Size=Slider(1, range=0..10),
    Colour=ColourSwatch(SwatchColor=RGB(255, 255, 255)),
    Justification=7)

# ----
# tripod mesh pipe
crossref = CrossReference(ListA=btparser.tips_points, ListB=btparser.tips_points, CrossMode=5)  # -> ListA, ListB

# ---- group: insert core point
lng_2 = ListLength(List=crossref.ListA)
dup = DuplicateData(Data=btparser.body_core_point, Number=lng_2, Order=True)

# ----
merge = Merge(Data1=simplify(graft(crossref.ListA)), Data2=simplify(graft(dup)), Data3=simplify(graft(crossref.ListB)))
pline = PolyLine(Vertices=merge, Closed=False)
fillet = Fillet(Curve=pline, Radius=Slider(5.045, range=0..10))
pshift_2 = ShiftPaths(Data=fillet, Offset=-1)
mpipe_2 = MeshPipe(Curve=pshift_2, Radius=Slider(1, range=0..1), Accuracy=0.2, Rotation=0, Segments="4", Caps="1")
mjoin_3 = MeshJoin(Meshes=flatten(mpipe_2))
f_sbpath = SerialBranchPath(T=pshift_2, i=Slider(11, range=0..100))  # -> P, D; inputs T: tree, i: Int32
# ---------- f_sbpath: C# ----------
                                            /*
    froGH - a sparse collection of (in)utilities for Grasshopper

    Serial Branch Path
    code by Alessio Erioli

    froGH by Co-de-iT is licensed under a Creative Commons Attribution 4.0 International License.
    http://creativecommons.org/licenses/by/4.0/

    */

    initComp();


    if (T.BranchCount > 0){
      int ind = i % T.BranchCount;
      P = T.Path(ind);
      D = T.Branches[ind];
    }
# ---------- f_sbpath: C# additional code ----------
  void initComp(){
    Component.Name = "Serial Branch Path";
    Component.NickName = "f_SBPath";
    Component.Description = "Retrieves the data tree path and data for a specific branch serial index";
    Component.Params.Input[0].Name = "Tree";
    Component.Params.Input[0].Description = "the data tree";
    Component.Params.Input[1].Name = "index";
    Component.Params.Input[1].Description = "serial index of branch to sample";
    Component.Params.Output[0].Name = "Path";
    Component.Params.Output[0].Description = "the tree branch path";
    Component.Params.Output[1].Name = "Data";
    Component.Params.Output[1].Description = "the tree branch content";
  }
# ---------- end f_sbpath ----------
meshpreview = MeshPreview(Mesh=mjoin_3)
previewlw_3 = CustomPreviewLineweights(
    Geometry=f_sbpath.D,
    Shader=ColourSwatch(SwatchColor=RGB(255, 255, 255)),
    Thickness=Slider(5, range=0..10),
    Absolute=False)

# ----
# free/connected points
len = TextLength(Text=btparser.connection_topology)
ma = MassAddition(Input=len)  # -> Result, PartialResults
equals = Equality(FirstNumber=ma.Result, SecondNumber=0)  # -> Equality, Inequality
dispatch = Dispatch(List=graft(btparser.tips_points), DispatchPattern=equals.Equality)  # -> ListA, ListB
dispatch_2 = Dispatch(List=btparser.connection_topology, DispatchPattern=equals.Equality)  # -> ListA, ListB
topology_for_connected_points = Panel(dispatch_2.ListB)

# ---- group: free tips
pt = Point(dispatch.ListA)

# ---- group: connected points
pt_2 = Point(dispatch.ListB)

# ----
msphere = MeshSphere(Base=pt_2, Radius=Slider(2.55, range=0..5), UCount="4", VCount="4")
mjoin_4 = MeshJoin(Meshes=flatten(msphere))
meshpreview_2 = MeshPreview(Mesh=mjoin_4)

# ==== cluster BodyTopologyParser: Parses a body topology file from Processing
file = ClusterInput()  # File to parse
# import format: 0 agent index
# 1 body type
# 2 core point
# 3 forward vector
# 4 > n-1 tips positions
# n tips connections
panel = Panel(" ")
split = TextSplit(Text=file, Separators=panel)  # -> simplify(Result)
cull_i = CullIndex(List=split, Indices="-1", Wrap=True)  # -> simplify(List)
item = ListItem(List=split, Index="-1", Wrap=True)
split_2 = SplitList(List=cull_i, Index="4")  # -> simplify(ListA), simplify(ListB)
split_3 = TextSplit(Text=item, Separators="_")
split_4 = TextSplit(Text=split_3, Separators=",")  # -> simplify(Result)
item_2 = ListItem(List=split_2.ListA, Index=0, Wrap=True)  # -> Item, Item1, Item2, Item3

# ---- group: connection topology
data = Data(split_4)

# ---- group: agent id
int = Integer(item_2.Item)

# ---- group: body type
int_2 = Integer(item_2.Item1)

# ---- group: body core
pt = Point(item_2.Item2)

# ---- group: forward vector
vec = Vector(item_2.Item3)

# ---- group: tip points
pt_2 = Point(split_2.ListB)

# ----
body_forward_vector = ClusterOutput(vec)
connection_topology = ClusterOutput(data)
agent_id = ClusterOutput(int)
body_type = ClusterOutput(int_2)
tips_points = ClusterOutput(pt_2)
body_core_point = ClusterOutput(pt)
